vi "Get_Start_date_Serial_Number.gviweb"   [G Web Development Software 22.3.0]
inputs:
  "file name": string
  "Error in": error
outputs:
  "Output Error": error
panel indicators:
  "Date and time": string
  "Error Code": string
  "Serial nummer": string
diagram:
  Replace Substring(string=$"file name", substring="-RAT-") -> (replaced substring=w1, result string=w2)
  $"Date and time" <- w2
  Replace Substring(string=w1, substring="-") -> (replaced substring=w3, result string=w4)
  $"Serial nummer" <- w4
  $"Error Code" <- w3
  $"Output Error" <- $"Error in"
