vi "Add_Seriennumber_to_Spec.gviweb"   [G Web Development Software 22.3.0]
inputs:
  "File name": string
  "Error Input": error
outputs:
  "General information": cluster{"Entry": string, "Information": string}[]
  "Error Output": error
  "SN": string
uses:
  NI::G Core::Strings::Search and Replace Pattern.gvi
diagram:
  Match Pattern(regular expression="-RAT-", string=$"File name") -> (after substring=w1, before substring=w2)
  Match Pattern(regular expression="-", string=w1) -> (after substring=w3, before substring=w4)
  String Subset(length (rest)=4, string=w2) -> w5
  String Subset(length (rest)=2, offset (0)=4, string=w2) -> w6
  String Subset(length (rest)=2, offset (0)=6, string=w2) -> w7
  String Subset(length (rest)=2, offset (0)=8, string=w2) -> w8
  String Subset(length (rest)=2, offset (0)=10, string=w2) -> w9
  String Subset(length (rest)=2, offset (0)=12, string=w2) -> w10
  Concatenate Strings(w5, ".", w6, ".", w7, " ", w8, ":", w9, ":", w10) -> w11
  call "Search and Replace Pattern.gvi"(string=w3, pattern=".xml", replace string="") -> (result string=w12)
  Insert Into Array(inArray=string[] [], new=w4, new=w11, new=w12) -> w13
  for {
    w14 = each element of ["Serial number", "Date and time", "Service Error", ""]
    w15 = each element of w13
    w17 = cluster{"Entry": string, "Information": string} {all zero or empty}
    Property Node(instance in=w17, "Entry"=w14, "Information"=w15) -> (instance out=w18)
    append w18 to w16
  }
  $"Error Output" <- $"Error Input"
  $"General information" <- w16
  $SN <- w4
