vi "Angles.gviweb"   [G Web Development Software 22.3.0]
inputs:
  "Angles array": string[]
  "Intput": error
outputs:
  "Angles": T1[]
  "Output": error
  "maximum Angles": f64[]
  "minimum Angles": f64[]
types:
  T1 = cluster{"Timestamp": string, "pt1": string, "pt1[ang]_lid": string, "pt1[ang]_pan": string, "pt2": string, "pt2[ang]_lid": string, "pt2[ang]_pan": string}
uses:
  WebApp::Read_XML_array.gviweb
  WebApp::Maximum_Angles.gviweb
  WebApp::Minimum_Angles.gviweb
diagram:
  w1 = T1 {all zero or empty}  # Cluster Constant
  # pt1, pt1[ang]_lid, pt1[ang]_pan, pt2, pt2[ang]_lid, pt2[ang]_pan
  s1 = T1[] []  # shift register
  for (iteration -> i1) {
    w2 = each element of $"Angles array"
    call "Read_XML_array.gviweb"(Input XML=w2, Error in=$Intput) -> (Output XML array=w3, Error out=w4)
    case (i1) {
      frame 0 {
        for {
          w6 = each element of w3
          Match Pattern(regular expression="=\"", string=w6) -> (after substring=w7)
          Match Pattern(regular expression="\">", string=w7) -> (after substring=w8, before substring=w9)
          Match Pattern(regular expression="</", string=w8) -> (before substring=w10)
          String Subset(length (rest)=2, string=w9) -> w11
          String Subset(length (rest)=2, offset (0)=2, string=w9) -> w12
          String Subset(offset (0)=4, string=w9) -> w13
          Concatenate Strings(w11, ":", w12, ":", w13) -> w14
          Property Node(instance in=w1, "Timestamp"=w14, "pt1"=w10) -> (instance out=w15)
          append w15 to w5
        }
      }
      frame 1 {
        for {
          w16 = each element of w3
          Match Pattern(regular expression="=\"", string=w16) -> (after substring=w18)
          Match Pattern(regular expression="\">", string=w18) -> (after substring=w19)
          Match Pattern(regular expression="</", string=w19) -> (before substring=w20)
          Property Node(instance in=w1, "pt1[ang]_lid"=w20) -> (instance out=w21)
          append w21 to w17
        }
        for {
          w22 = each element of s1
          w23 = each element of w17
          Property Node(instance in=w23) -> ("pt1[ang]_lid"=w24)
          Property Node(instance in=w22, "pt1[ang]_lid"=w24) -> (instance out=w25)
          append w25 to w5
        }
      }
      frame 2 {
        for {
          w26 = each element of w3
          Match Pattern(regular expression="=\"", string=w26) -> (after substring=w28)
          Match Pattern(regular expression="\">", string=w28) -> (after substring=w29)
          Match Pattern(regular expression="</", string=w29) -> (before substring=w30)
          Property Node(instance in=w1, "pt1[ang]_pan"=w30) -> (instance out=w31)
          append w31 to w27
        }
        for {
          w32 = each element of s1
          w33 = each element of w27
          Property Node(instance in=w33) -> ("pt1[ang]_pan"=w34)
          Property Node(instance in=w32, "pt1[ang]_pan"=w34) -> (instance out=w35)
          append w35 to w5
        }
      }
      frame 3 {
        for {
          w36 = each element of w3
          Match Pattern(regular expression="=\"", string=w36) -> (after substring=w38)
          Match Pattern(regular expression="\">", string=w38) -> (after substring=w39)
          Match Pattern(regular expression="</", string=w39) -> (before substring=w40)
          Property Node(instance in=w1, "pt2"=w40) -> (instance out=w41)
          append w41 to w37
        }
        for {
          w42 = each element of s1
          w43 = each element of w37
          Property Node(instance in=w43) -> ("pt2"=w44)
          Property Node(instance in=w42, "pt2"=w44) -> (instance out=w45)
          append w45 to w5
        }
      }
      frame 4 {
        for {
          w46 = each element of w3
          Match Pattern(regular expression="=\"", string=w46) -> (after substring=w48)
          Match Pattern(regular expression="\">", string=w48) -> (after substring=w49)
          Match Pattern(regular expression="</", string=w49) -> (before substring=w50)
          Property Node(instance in=w1, "pt2[ang]_lid"=w50) -> (instance out=w51)
          append w51 to w47
        }
        for {
          w52 = each element of s1
          w53 = each element of w47
          Property Node(instance in=w53) -> ("pt2[ang]_lid"=w54)
          Property Node(instance in=w52, "pt2[ang]_lid"=w54) -> (instance out=w55)
          append w55 to w5
        }
      }
      frame 5, Default {
        for {
          w56 = each element of w3
          Match Pattern(regular expression="=\"", string=w56) -> (after substring=w58)
          Match Pattern(regular expression="\">", string=w58) -> (after substring=w59)
          Match Pattern(regular expression="</", string=w59) -> (before substring=w60)
          Property Node(instance in=w1, "pt2[ang]_pan"=w60) -> (instance out=w61)
          append w61 to w57
        }
        for {
          w62 = each element of s1
          w63 = each element of w57
          Property Node(instance in=w63) -> ("pt2[ang]_pan"=w64)
          Property Node(instance in=w62, "pt2[ang]_pan"=w64) -> (instance out=w65)
          append w65 to w5
        }
      }
    }
    next s1 = w5
  }
  $Angles <- s1
  call "Maximum_Angles.gviweb"(Angles=s1) -> (maximum Angles=w66)
  $"maximum Angles" <- w66
  call "Minimum_Angles.gviweb"(Angles=s1) -> (minimum Angles=w67)
  $"minimum Angles" <- w67
  $Output <- w4
