vi "General_Information.gviweb"   [G Web Development Software 22.3.0]
inputs:
  "File name": string
  "Error Input": error
outputs:
  "General information": cluster{"Entry": string, "Information": string}[]
  "Error Output": error
  "Device type": string
uses:
  WebApp::Get_Serial_Number.gviweb
  NI::G Core::Strings::Search and Replace Pattern.gvi
diagram:
  w1 = ["Serial number", "Date and time", "Service Error", "Device type"]
  Match Pattern(regular expression="-RAT-", string=$"File name") -> (after substring=w2, before substring=w3)
  Match Pattern(regular expression="-", string=w2) -> (after substring=w4, before substring=w5)
  call "Get_Serial_Number.gviweb"(Serial number=w5, Intput=$"Error Input") -> (Device type=w6, Output=w7)
  String Subset(length (rest)=4, string=w3) -> w8
  String Subset(length (rest)=2, offset (0)=4, string=w3) -> w9
  String Subset(length (rest)=2, offset (0)=6, string=w3) -> w10
  String Subset(length (rest)=2, offset (0)=8, string=w3) -> w11
  String Subset(length (rest)=2, offset (0)=10, string=w3) -> w12
  String Subset(length (rest)=2, offset (0)=12, string=w3) -> w13
  Concatenate Strings(w8, ".", w9, ".", w10, " ", w11, ":", w12, ":", w13) -> w14
  call "Search and Replace Pattern.gvi"(string=w4, pattern=".xml", replace string="") -> (result string=w15)
  Insert Into Array(inArray=string[] [], new=w5, new=w14, new=w15, new=w6) -> w16
  for {
    w17 = each element of w1
    w18 = each element of w16
    w20 = cluster{"Entry": string, "Information": string} {all zero or empty}
    Property Node(instance in=w20, "Entry"=w17, "Information"=w18) -> (instance out=w21)
    append w21 to w19
  }
  $"Error Output" <- w7
  $"General information" <- w19
  $"Device type" <- w6
