vi "Get_Date_and_Time.gviweb"   [G Web Development Software 22.3.0]
inputs:
  "Time": string
  "Input": error
outputs:
  "Time_output": f64
  "Output": error
  "timestamp": timestamp
panel indicators:
  "date and time string": string
  "output 1": timestamp
  "remaining string": string
uses:
  NI::G Core::Strings::Search and Replace Pattern.gvi
diagram:
  Format Date Time String(UTC format=FALSE, time format string (%c)=$Time) -> (date/time string=w1)
  $"date and time string" <- w1
  Search Or Split String(offset=6, string=$Time) -> (match + rest of string=w2)
  Floating Point String To Number(string=w2, use system decimal point (T)=TRUE) -> (number=w3)
  Search Or Split String(offset=2, search string/char=":", string=w1) -> (match + rest of string=w4, substring before match=w5)
  call "Search and Replace Pattern.gvi"(string=w4, pattern=":") -> (result string=w6)
  Floating Point String To Number(string=w6) -> (number=w7)
  Multiply(w7, 60) -> w8
  call "Search and Replace Pattern.gvi"(string=w5, pattern=":") -> (result string=w9)
  Floating Point String To Number(string=w9) -> (number=w10)
  Multiply(w10, 3600) -> w11
  Add(w8, w11, w3) -> w12
  $Time_output <- w12
  To Timestamp(number=w12) -> w13
  $timestamp <- w13
  $Output <- $Input
  Concatenate Strings("2026.02.01", "", $Time) -> w14
  Scan From String(formatString="%<%Y.%m.%d %H:%M:%S>T", inputString=w14, default=1904-01-01T00:00:00Z) -> (outString=w15, out0=w16)
  $"remaining string" <- w15
  $"output 1" <- w16
