vi "Graph_Angles.gviweb"   [G Web Development Software 22.3.0]
inputs:
  "Angles": T1[]
  "Input": error
outputs:
  "Curve singel": cluster{"Element 1": f64[], "Element 2": f64[]}[]
  "Output": error
types:
  T1 = cluster{"Timestamp": string, "pt1": string, "pt1[ang]_lid": string, "pt1[ang]_pan": string, "pt2": string, "pt2[ang]_lid": string, "pt2[ang]_pan": string}
uses:
  WebApp::Get_Date_and_Time.gviweb
diagram:
  for {
    w1 = each element of $Angles
    Property Node(instance in=w1) -> ("pt1"=w9, "pt1[ang]_lid"=w10, "pt1[ang]_pan"=w11, "pt2"=w12, "pt2[ang]_lid"=w13, "pt2[ang]_pan"=w14, "Timestamp"=w15)
    Floating Point String To Number(string=w9, use system decimal point (T)=TRUE) -> (number=w16)
    Floating Point String To Number(string=w10, use system decimal point (T)=TRUE) -> (number=w17)
    Floating Point String To Number(string=w11, use system decimal point (T)=TRUE) -> (number=w18)
    call "Get_Date_and_Time.gviweb"(Time=w15, Input=$Input) -> (Time_output=w19, Output=w20)
    Floating Point String To Number(string=w12, use system decimal point (T)=TRUE) -> (number=w21)
    Floating Point String To Number(string=w13, use system decimal point (T)=TRUE) -> (number=w22)
    Floating Point String To Number(string=w14, use system decimal point (T)=TRUE) -> (number=w23)
    append w16 to w2
    append w17 to w3
    append w18 to w4
    append w21 to w5
    append w22 to w6
    append w23 to w7
    append w19 to w8
  }
  $Output <- w20
  Build Cluster(w8, w2) -> w24
  Build Cluster(w8, w3) -> w25
  Build Cluster(w8, w4) -> w26
  Build Cluster(w8, w5) -> w27
  Build Cluster(w8, w6) -> w28
  Build Cluster(w8, w7) -> w29
  Build Array(w24, w25, w26, w27, w28, w29) -> w30
  $"Curve singel" <- w30
