vi "Graph_Pressure.gviweb"   [G Web Development Software 22.3.0]
inputs:
  "Left side pressure data": T1[]
  "Input": error
  "Right side pressure data": T2[]
outputs:
  "Curve singel": cluster{"Element 1": f64[], "Element 2": f64[]}[]
  "Output": error
types:
  T1 = cluster{"Timestamp": string, "Pressure_offset/ Left": string, "Pressure_offset_date/ Left": string, "Pressure_offset_time/ Left": string, "Pressure_phase/ Left": string, "P1_absolute": string, "P1_relative": string, "P3_I/O_pressure": string, "Pressure_in_pan/ Left": string}
  T2 = cluster{"Timestamp": string, "P2_absolute": string, "P2_relative": string, "Pressure_in_pan/ Right": string, "Right_pressure_offset": string, "Right_pressure_offset_date": string, "Right_pressure_offset_time": string, "Pressure_phase/ Right": string}
uses:
  WebApp::Get_Date_and_Time.gviweb
diagram:
  for {
    w1 = each element of $"Left side pressure data"
    Property Node(instance in=w1) -> ("P1_absolute"=w7, "P1_relative"=w8, "P3_I/O_pressure"=w9, "Pressure_in_pan/ Left"=w10, "Timestamp"=w11)
    Floating Point String To Number(string=w7, use system decimal point (T)=TRUE) -> (number=w12)
    Floating Point String To Number(string=w8, use system decimal point (T)=TRUE) -> (number=w13)
    Floating Point String To Number(string=w9, use system decimal point (T)=TRUE) -> (number=w14)
    Floating Point String To Number(string=w10, use system decimal point (T)=TRUE) -> (number=w15)
    call "Get_Date_and_Time.gviweb"(Time=w11, Input=$Input) -> (Time_output=w16, Output=w17)
    append w12 to w2
    append w13 to w3
    append w14 to w4
    append w15 to w5
    append w16 to w6
  }
  for {
    w18 = each element of $"Right side pressure data"
    Property Node(instance in=w18) -> ("P2_absolute"=w23, "P2_relative"=w24, "Pressure_in_pan/ Right"=w25, "Timestamp"=w26)
    Floating Point String To Number(string=w23, use system decimal point (T)=TRUE) -> (number=w27)
    Floating Point String To Number(string=w24, use system decimal point (T)=TRUE) -> (number=w28)
    Floating Point String To Number(string=w25, use system decimal point (T)=TRUE) -> (number=w29)
    call "Get_Date_and_Time.gviweb"(Time=w26, Input=w17) -> (Time_output=w30, Output=w31)
    append w27 to w19
    append w28 to w20
    append w29 to w21
    append w30 to w22
  }
  $Output <- w31
  Build Cluster(w6, w2) -> w32
  Build Cluster(w6, w3) -> w33
  Build Cluster(w6, w4) -> w34
  Build Cluster(w6, w5) -> w35
  Build Cluster(w22, w19) -> w36
  Build Cluster(w22, w20) -> w37
  Build Cluster(w22, w21) -> w38
  Build Array(w32, w33, w34, w35, w36, w37, w38) -> w39
  $"Curve singel" <- w39
