vi "Graph_Temp.gviweb"   [G Web Development Software 22.3.0]
inputs:
  "Temperature sensors": T1[]
  "Input": error
outputs:
  "Curve singel": cluster{"Element 1": f64[], "Element 2": f64[]}[]
  "Output": error
types:
  T1 = cluster{"Timestamp": string, "B101": string, "B102": string, "B103": string, "B104": string, "B105": string, "B106": string, "B201": string, "B301": string, "B302": string, "B303": string, "B304": string, "B305": string, "B306": string}
uses:
  WebApp::Get_Date_and_Time.gviweb
diagram:
  for {
    w1 = each element of $"Temperature sensors"
    Property Node(instance in=w1) -> ("B101"=w16, "B102"=w17, "B103"=w18, "B104"=w19, "B105"=w20, "B106"=w21, "B201"=w22, "B301"=w23, "B302"=w24, "B303"=w25, "B304"=w26, "B305"=w27, "B306"=w28, "Timestamp"=w29)
    Floating Point String To Number(string=w16, use system decimal point (T)=TRUE) -> (number=w30)
    Floating Point String To Number(string=w17, use system decimal point (T)=TRUE) -> (number=w31)
    Floating Point String To Number(string=w18, use system decimal point (T)=TRUE) -> (number=w32)
    Floating Point String To Number(string=w19, use system decimal point (T)=TRUE) -> (number=w33)
    Floating Point String To Number(string=w20, use system decimal point (T)=TRUE) -> (number=w34)
    Floating Point String To Number(string=w21, use system decimal point (T)=TRUE) -> (number=w35)
    Floating Point String To Number(string=w22, use system decimal point (T)=TRUE) -> (number=w36)
    Floating Point String To Number(string=w23, use system decimal point (T)=TRUE) -> (number=w37)
    call "Get_Date_and_Time.gviweb"(Time=w29, Input=$Input) -> (Time_output=w38, Output=w39)
    Floating Point String To Number(string=w24, use system decimal point (T)=TRUE) -> (number=w40)
    Floating Point String To Number(string=w25, use system decimal point (T)=TRUE) -> (number=w41)
    Floating Point String To Number(string=w26, use system decimal point (T)=TRUE) -> (number=w42)
    Floating Point String To Number(string=w27, use system decimal point (T)=TRUE) -> (number=w43)
    Floating Point String To Number(string=w28, use system decimal point (T)=TRUE) -> (number=w44)
    append w30 to w2
    append w31 to w3
    append w32 to w4
    append w33 to w5
    append w34 to w6
    append w35 to w7
    append w36 to w8
    append w37 to w9
    append w40 to w10
    append w41 to w11
    append w42 to w12
    append w43 to w13
    append w44 to w14
    append w38 to w15
  }
  Build Cluster(w15, w2) -> w45
  Build Cluster(w15, w3) -> w46
  Build Cluster(w15, w4) -> w47
  Build Cluster(w15, w5) -> w48
  Build Cluster(w15, w6) -> w49
  Build Cluster(w15, w7) -> w50
  Build Cluster(w15, w8) -> w51
  Build Cluster(w15, w9) -> w52
  Build Cluster(w15, w10) -> w53
  Build Cluster(w15, w11) -> w54
  Build Cluster(w15, w12) -> w55
  Build Cluster(w15, w13) -> w56
  Build Cluster(w15, w14) -> w57
  Build Array(w45, w46, w47, w48, w49, w50, w51, w52, w53, w54, w55, w56, w57) -> w58
  $"Curve singel" <- w58
  $Output <- w39
