vi "Graph_Temp_PCBs.gviweb"   [G Web Development Software 22.3.0]
inputs:
  "PCB Temperature": T1[]
  "Input": error
outputs:
  "Curve singel": cluster{"Element 1": f64[], "Element 2": f64[]}[]
  "Output": error
types:
  T1 = cluster{"Timestamp": string, "CPU temperature": string, "IO temperature": string}
uses:
  WebApp::Get_Date_and_Time.gviweb
diagram:
  for {
    w1 = each element of $"PCB Temperature"
    Property Node(instance in=w1) -> ("CPU temperature"=w5, "IO temperature"=w6, "Timestamp"=w7)
    Floating Point String To Number(string=w5, use system decimal point (T)=TRUE) -> (number=w8)
    call "Get_Date_and_Time.gviweb"(Time=w7, Input=$Input) -> (Time_output=w9, Output=w10)
    Floating Point String To Number(string=w6, use system decimal point (T)=TRUE) -> (number=w11)
    append w8 to w2
    append w11 to w3
    append w9 to w4
  }
  $Output <- w10
  Build Cluster(w4, w2) -> w12
  Build Cluster(w4, w3) -> w13
  Build Array(w12, w13) -> w14
  $"Curve singel" <- w14
