vi "Maximum _PCB.gviweb"   [G Web Development Software 22.3.0]
inputs:
  "Temperature sensors": T1[]
outputs:
  "maximum": f64[]
types:
  T1 = cluster{"Timestamp": string, "CPU": string, "IO": string}
diagram:
  s1 = 0  # shift register
  s2 = 0  # shift register
  for {
    w1 = each element of $"Temperature sensors"
    Property Node(instance in=w1) -> ("CPU"=w2, "IO"=w3)
    Floating Point String To Number(string=w2, use system decimal point (T)=TRUE) -> (number=w4)
    Is Greater(x=w4, y=s1) -> w5
    case (w5) {
      frame False, Default {
        w6 = s1
      }
      frame True {
        w6 = w4
      }
    }
    Floating Point String To Number(string=w3, use system decimal point (T)=TRUE) -> (number=w7)
    Is Greater(x=w7, y=s2) -> w8
    case (w8) {
      frame False, Default {
        w9 = s2
      }
      frame True {
        w9 = w7
      }
    }
    next s1 = w6
    next s2 = w9
  }
  Insert Into Array(inArray=f64[] [], new=s1, new=s2) -> w10
  $maximum <- w10
