vi "Maximum_Angles.gviweb"   [G Web Development Software 22.3.0]
inputs:
  "Angles": T1[]
outputs:
  "maximum Angles": f64[]
types:
  T1 = cluster{"Timestamp": string, "pt1": string, "pt1[ang]_lid": string, "pt1[ang]_pan": string, "pt2": string, "pt2[ang]_lid": string, "pt2[ang]_pan": string}
diagram:
  s1 = 0  # shift register
  s2 = 0  # shift register
  s3 = 0  # shift register
  s4 = 0  # shift register
  s5 = 0  # shift register
  for {
    w1 = each element of $Angles
    Property Node(instance in=w1) -> ("pt1"=w2, "pt1[ang]_lid"=w3, "pt1[ang]_pan"=w4, "pt2"=w5, "pt2[ang]_lid"=w6, "pt2[ang]_pan"=w7)
    Floating Point String To Number(string=w2, use system decimal point (T)=TRUE) -> (number=w8)
    Is Greater(x=w8, y=s1) -> w9
    case (w9) {
      frame False, Default {
        w10 = s1
      }
      frame True {
        w10 = w8
      }
    }
    Floating Point String To Number(string=w3, use system decimal point (T)=TRUE) -> (number=w11)
    Is Greater(x=w11, y=s2) -> w12
    case (w12) {
      frame False, Default {
        w13 = s2
      }
      frame True {
        w13 = w11
      }
    }
    Floating Point String To Number(string=w4, use system decimal point (T)=TRUE) -> (number=w14)
    Is Greater(x=w14, y=s3) -> w15
    case (w15) {
      frame False, Default {
        w16 = s3
      }
      frame True {
        w16 = w14
      }
    }
    Floating Point String To Number(string=w5, use system decimal point (T)=TRUE) -> (number=w17)
    Is Greater(x=w17, y=s4) -> w18
    case (w18) {
      frame False, Default {
        w19 = s4
      }
      frame True {
        w19 = w17
      }
    }
    Floating Point String To Number(string=w6, use system decimal point (T)=TRUE) -> (number=w20)
    Is Greater(x=w20, y=s5) -> w21
    case (w21) {
      frame False, Default {
        w22 = s5
      }
      frame True {
        w22 = w20
      }
    }
    Floating Point String To Number(string=w7, use system decimal point (T)=TRUE) -> (number=w23)
    Is Greater(x=w23, y=0) -> w24
    case (w24) {
      frame False, Default {
        w25 = 0
      }
      frame True {
        w25 = w23
      }
    }
    next s1 = w10
    next s2 = w13
    next s3 = w16
    next s4 = w19
    next s5 = w22
  }
  Insert Into Array(inArray=f64[] [], new=s1, new=s2, new=s3, new=s4, new=s5, new=w25) -> w26
  $"maximum Angles" <- w26
