vi "Maximum_Pressure_Left.gviweb"   [G Web Development Software 22.3.0]
inputs:
  "Left side pressure Pressure Left": T1[]
outputs:
  "maximum Pressure left": f64[]
types:
  T1 = cluster{"Timestamp": string, "Pressure_offset/ Left": string, "Pressure_offset_date/ Left": string, "Pressure_offset_time/ Left": string, "Pressure_phase/ Left": string, "P1_absolute": string, "P1_relative": string, "P3_I/O_pressure": string, "Pressure_in_pan/ Left": string}
diagram:
  s1 = 0  # shift register
  s2 = 0  # shift register
  s3 = 0  # shift register
  s4 = 0  # shift register
  for {
    w1 = each element of $"Left side pressure Pressure Left"
    Property Node(instance in=w1) -> ("P1_absolute"=w2, "P1_relative"=w3, "P3_I/O_pressure"=w4, "Pressure_in_pan/ Left"=w5)
    Floating Point String To Number(string=w2, use system decimal point (T)=TRUE) -> (number=w6)
    Is Greater(x=w6, y=s1) -> w7
    case (w7) {
      frame False, Default {
        w8 = s1
      }
      frame True {
        w8 = w6
      }
    }
    Floating Point String To Number(string=w3, use system decimal point (T)=TRUE) -> (number=w9)
    Is Greater(x=w9, y=s2) -> w10
    case (w10) {
      frame False, Default {
        w11 = s2
      }
      frame True {
        w11 = w9
      }
    }
    Floating Point String To Number(string=w4, use system decimal point (T)=TRUE) -> (number=w12)
    Is Greater(x=w12, y=s3) -> w13
    case (w13) {
      frame False, Default {
        w14 = s3
      }
      frame True {
        w14 = w12
      }
    }
    Floating Point String To Number(string=w5, use system decimal point (T)=TRUE) -> (number=w15)
    Is Greater(x=w15, y=s4) -> w16
    case (w16) {
      frame False, Default {
        w17 = s4
      }
      frame True {
        w17 = w15
      }
    }
    next s1 = w8
    next s2 = w11
    next s3 = w14
    next s4 = w17
  }
  Insert Into Array(inArray=f64[] [], new=s1, new=s2, new=s3, new=s4) -> w18
  $"maximum Pressure left" <- w18
