vi "Maximum_Pressure_Right.gviweb"   [G Web Development Software 22.3.0]
inputs:
  "Right side pressure data": T1[]
outputs:
  "maximum Pressure left": f64[]
types:
  T1 = cluster{"Timestamp": string, "P2_absolute": string, "P2_relative": string, "Pressure_in_pan/ Right": string, "Right_pressure_offset": string, "Right_pressure_offset_date": string, "Right_pressure_offset_time": string, "Pressure_phase/ Right": string}
diagram:
  s1 = 0  # shift register
  s2 = 0  # shift register
  s3 = 0  # shift register
  for {
    w1 = each element of $"Right side pressure data"
    Property Node(instance in=w1) -> ("P2_absolute"=w2, "P2_relative"=w3, "Pressure_in_pan/ Right"=w4)
    Floating Point String To Number(string=w2, use system decimal point (T)=TRUE) -> (number=w5)
    Is Greater(x=w5, y=s1) -> w6
    case (w6) {
      frame False, Default {
        w7 = s1
      }
      frame True {
        w7 = w5
      }
    }
    Floating Point String To Number(string=w3, use system decimal point (T)=TRUE) -> (number=w8)
    Is Greater(x=w8, y=s2) -> w9
    case (w9) {
      frame False, Default {
        w10 = s2
      }
      frame True {
        w10 = w8
      }
    }
    Floating Point String To Number(string=w4, use system decimal point (T)=TRUE) -> (number=w11)
    Is Greater(x=w11, y=s3) -> w12
    case (w12) {
      frame False, Default {
        w13 = s3
      }
      frame True {
        w13 = w11
      }
    }
    next s1 = w7
    next s2 = w10
    next s3 = w13
  }
  Insert Into Array(inArray=f64[] [], new=s1, new=s2, new=s3) -> w14
  $"maximum Pressure left" <- w14
