vi "Maximum_Temp_Right.gviweb"   [G Web Development Software 22.3.0]
inputs:
  "Temperature sensors": T1[]
outputs:
  "maximum right": f64[]
types:
  T1 = cluster{"Timestamp": string, "B107": string, "B108": string, "B109": string, "B110": string, "B111": string, "B112": string, "B211": string, "B311": string, "B312": string, "B313": string, "B314": string, "B315": string, "B316": string}
diagram:
  s1 = 0  # shift register
  s2 = 0  # shift register
  s3 = 0  # shift register
  s4 = 0  # shift register
  s5 = 0  # shift register
  s6 = 0  # shift register
  s7 = 0  # shift register
  s8 = 0  # shift register
  s9 = 0  # shift register
  s10 = 0  # shift register
  s11 = 0  # shift register
  s12 = 0  # shift register
  s13 = 0  # shift register
  for {
    w1 = each element of $"Temperature sensors"
    Property Node(instance in=w1) -> ("B107"=w2, "B108"=w3, "B109"=w4, "B110"=w5, "B111"=w6, "B112"=w7, "B112"=w8, "B311"=w9, "B312"=w10, "B313"=w11, "B314"=w12, "B315"=w13, "B316"=w14)
    Floating Point String To Number(string=w2, use system decimal point (T)=TRUE) -> (number=w15)
    Is Greater(x=w15, y=s1) -> w16
    case (w16) {
      frame False, Default {
        w17 = s1
      }
      frame True {
        w17 = w15
      }
    }
    Floating Point String To Number(string=w3, use system decimal point (T)=TRUE) -> (number=w18)
    Is Greater(x=w18, y=s2) -> w19
    case (w19) {
      frame False, Default {
        w20 = s2
      }
      frame True {
        w20 = w18
      }
    }
    Floating Point String To Number(string=w4, use system decimal point (T)=TRUE) -> (number=w21)
    Is Greater(x=w21, y=s3) -> w22
    case (w22) {
      frame False, Default {
        w23 = s3
      }
      frame True {
        w23 = w21
      }
    }
    Floating Point String To Number(string=w5, use system decimal point (T)=TRUE) -> (number=w24)
    Is Greater(x=w24, y=s4) -> w25
    case (w25) {
      frame False, Default {
        w26 = s4
      }
      frame True {
        w26 = w24
      }
    }
    Floating Point String To Number(string=w6, use system decimal point (T)=TRUE) -> (number=w27)
    Is Greater(x=w27, y=s5) -> w28
    case (w28) {
      frame False, Default {
        w29 = s5
      }
      frame True {
        w29 = w27
      }
    }
    Floating Point String To Number(string=w7, use system decimal point (T)=TRUE) -> (number=w30)
    Is Greater(x=w30, y=s6) -> w31
    case (w31) {
      frame False, Default {
        w32 = s6
      }
      frame True {
        w32 = w30
      }
    }
    Floating Point String To Number(string=w8, use system decimal point (T)=TRUE) -> (number=w33)
    Is Greater(x=w33, y=s7) -> w34
    case (w34) {
      frame False, Default {
        w35 = s7
      }
      frame True {
        w35 = w33
      }
    }
    Floating Point String To Number(string=w9, use system decimal point (T)=TRUE) -> (number=w36)
    Is Greater(x=w36, y=s8) -> w37
    case (w37) {
      frame False, Default {
        w38 = s8
      }
      frame True {
        w38 = w36
      }
    }
    Floating Point String To Number(string=w10, use system decimal point (T)=TRUE) -> (number=w39)
    Is Greater(x=w39, y=s9) -> w40
    case (w40) {
      frame False, Default {
        w41 = s9
      }
      frame True {
        w41 = w39
      }
    }
    Floating Point String To Number(string=w11, use system decimal point (T)=TRUE) -> (number=w42)
    Is Greater(x=w42, y=s10) -> w43
    case (w43) {
      frame False, Default {
        w44 = s10
      }
      frame True {
        w44 = w42
      }
    }
    Floating Point String To Number(string=w12, use system decimal point (T)=TRUE) -> (number=w45)
    Is Greater(x=w45, y=s11) -> w46
    case (w46) {
      frame False, Default {
        w47 = s11
      }
      frame True {
        w47 = w45
      }
    }
    Floating Point String To Number(string=w13, use system decimal point (T)=TRUE) -> (number=w48)
    Is Greater(x=w48, y=s12) -> w49
    case (w49) {
      frame False, Default {
        w50 = s12
      }
      frame True {
        w50 = w48
      }
    }
    Floating Point String To Number(string=w14, use system decimal point (T)=TRUE) -> (number=w51)
    Is Greater(x=w51, y=s13) -> w52
    case (w52) {
      frame False, Default {
        w53 = s13
      }
      frame True {
        w53 = w51
      }
    }
    next s1 = w17
    next s2 = w20
    next s3 = w23
    next s4 = w26
    next s5 = w29
    next s6 = w32
    next s7 = w35
    next s8 = w38
    next s9 = w41
    next s10 = w44
    next s11 = w47
    next s12 = w50
    next s13 = w53
  }
  Insert Into Array(inArray=f64[] [], new=s1, new=s2, new=s3, new=s4, new=s5, new=s6, new=s7, new=s8, new=s9, new=s10, new=s11, new=s12, new=s13) -> w54
  $"maximum right" <- w54
