vi "Micoswitch.gviweb"   [G Web Development Software 22.3.0]
inputs:
  "Micoswitch array": string[]
  "Intput": error
outputs:
  "Microswitch": T1[]
  "Output": error
types:
  T1 = cluster{"Timestamp": string, "S11": string, "S111": string, "S12": string, "S13": string, "Safety Chain Voltage": string}
uses:
  WebApp::Read_XML_array.gviweb
  WebApp::Switch_State.gviweb
diagram:
  w1 = T1 {all zero or empty}  # Cluster Constant
  s1 = T1[] []  # shift register
  for (iteration -> i1) {
    w2 = each element of $"Micoswitch array"
    call "Read_XML_array.gviweb"(Input XML=w2, Error in=$Intput) -> (Output XML array=w3, Error out=w4)
    case (i1) {
      frame 0 {
        for {
          w6 = each element of w3
          Match Pattern(regular expression="=\"", string=w6) -> (after substring=w7)
          Match Pattern(regular expression="\">", string=w7) -> (after substring=w8, before substring=w9)
          String Subset(length (rest)=2, string=w9) -> w10
          String Subset(length (rest)=2, offset (0)=2, string=w9) -> w11
          String Subset(offset (0)=4, string=w9) -> w12
          Concatenate Strings(w10, ":", w11, ":", w12) -> w13
          Match Pattern(regular expression="</", string=w8) -> (before substring=w14)
          call "Switch_State.gviweb"(String input=w14) -> (Output=w15)
          Property Node(instance in=w1, "Timestamp"=w13, "S11"=w15) -> (instance out=w16)
          append w16 to w5
        }
      }
      frame 1 {
        for {
          w17 = each element of w3
          Match Pattern(regular expression="=\"", string=w17) -> (after substring=w19)
          Match Pattern(regular expression="\">", string=w19) -> (after substring=w20)
          Match Pattern(regular expression="</", string=w20) -> (before substring=w21)
          Property Node(instance in=w1, "S111"=w21) -> (instance out=w22)
          append w22 to w18
        }
        for {
          w23 = each element of s1
          w24 = each element of w18
          Property Node(instance in=w24) -> ("S111"=w25)
          Property Node(instance in=w23, "S111"=w25) -> (instance out=w26)
          append w26 to w5
        }
      }
      frame 2 {
        for {
          w27 = each element of w3
          Match Pattern(regular expression="=\"", string=w27) -> (after substring=w29)
          Match Pattern(regular expression="\">", string=w29) -> (after substring=w30)
          Match Pattern(regular expression="</", string=w30) -> (before substring=w31)
          call "Switch_State.gviweb"(String input=w31) -> (Output=w32)
          Property Node(instance in=w1, "S12"=w32) -> (instance out=w33)
          append w33 to w28
        }
        for {
          w34 = each element of s1
          w35 = each element of w28
          Property Node(instance in=w35) -> ("S12"=w36)
          Property Node(instance in=w34, "S12"=w36) -> (instance out=w37)
          append w37 to w5
        }
      }
      frame 3 {
        for {
          w38 = each element of w3
          Match Pattern(regular expression="=\"", string=w38) -> (after substring=w40)
          Match Pattern(regular expression="\">", string=w40) -> (after substring=w41)
          Match Pattern(regular expression="</", string=w41) -> (before substring=w42)
          call "Switch_State.gviweb"(String input=w42) -> (Output=w43)
          Property Node(instance in=w1, "S13"=w43) -> (instance out=w44)
          append w44 to w39
        }
        for {
          w45 = each element of s1
          w46 = each element of w39
          Property Node(instance in=w46) -> ("S13"=w47)
          Property Node(instance in=w45, "S13"=w47) -> (instance out=w48)
          append w48 to w5
        }
      }
      frame 4, Default {
        for {
          w49 = each element of w3
          Match Pattern(regular expression="=\"", string=w49) -> (after substring=w51)
          Match Pattern(regular expression="\">", string=w51) -> (after substring=w52)
          Match Pattern(regular expression="</", string=w52) -> (before substring=w53)
          Property Node(instance in=w1, "Safety Chain Voltage"=w53) -> (instance out=w54)
          append w54 to w50
        }
        for {
          w55 = each element of s1
          w56 = each element of w50
          Property Node(instance in=w56) -> ("Safety Chain Voltage"=w57)
          Property Node(instance in=w55, "Safety Chain Voltage"=w57) -> (instance out=w58)
          append w58 to w5
        }
      }
    }
    next s1 = w5
  }
  $Microswitch <- s1
  $Output <- w4
