vi "Minimum_Angles.gviweb"   [G Web Development Software 22.3.0]
inputs:
  "Angles": T1[]
outputs:
  "minimum Angles": f64[]
types:
  T1 = cluster{"Timestamp": string, "pt1": string, "pt1[ang]_lid": string, "pt1[ang]_pan": string, "pt2": string, "pt2[ang]_lid": string, "pt2[ang]_pan": string}
uses:
  WebApp::Maximum_Left.gviweb
diagram:
  s1 = 0  # shift register
  s2 = 0  # shift register
  s3 = 0  # shift register
  s4 = 0  # shift register
  s5 = 0  # shift register
  s6 = 0  # shift register
  for (iteration -> i1) {
    w1 = each element of $Angles
    case (i1) {
      frame 0 {
        Property Node(instance in=w1) -> ("pt1"=w8, "pt1[ang]_lid"=w9, "pt1[ang]_pan"=w10, "pt2"=w11, "pt2[ang]_lid"=w12, "pt2[ang]_pan"=w13)
        Floating Point String To Number(string=w8, use system decimal point (T)=TRUE) -> (number=w6)
        Floating Point String To Number(string=w9, use system decimal point (T)=TRUE) -> (number=w5)
        Floating Point String To Number(string=w10, use system decimal point (T)=TRUE) -> (number=w2)
        Floating Point String To Number(string=w11, use system decimal point (T)=TRUE) -> (number=w4)
        Floating Point String To Number(string=w12, use system decimal point (T)=TRUE) -> (number=w7)
        Floating Point String To Number(string=w13, use system decimal point (T)=TRUE) -> (number=w3)
      }
      frame 1, Default {
        Property Node(instance in=w1) -> ("pt1"=w14, "pt1[ang]_lid"=w15, "pt1[ang]_pan"=w16, "pt2"=w17, "pt2[ang]_lid"=w18, "pt2[ang]_pan"=w19)
        Floating Point String To Number(string=w14, use system decimal point (T)=TRUE) -> (number=w20)
        Is Less(x=w20, y=s1) -> w21
        case (w21) {
          frame False, Default {
            w6 = s1
          }
          frame True {
            w6 = w20
          }
        }
        Floating Point String To Number(string=w15, use system decimal point (T)=TRUE) -> (number=w22)
        Is Less(x=w22, y=s2) -> w23
        case (w23) {
          frame False, Default {
            w5 = s2
          }
          frame True {
            w5 = w22
          }
        }
        Floating Point String To Number(string=w16, use system decimal point (T)=TRUE) -> (number=w24)
        Is Less(x=w24, y=s3) -> w25
        case (w25) {
          frame False, Default {
            w2 = s3
          }
          frame True {
            w2 = w24
          }
        }
        Floating Point String To Number(string=w17, use system decimal point (T)=TRUE) -> (number=w26)
        Is Less(x=w26, y=s4) -> w27
        case (w27) {
          frame False, Default {
            w4 = s4
          }
          frame True {
            w4 = w26
          }
        }
        Floating Point String To Number(string=w18, use system decimal point (T)=TRUE) -> (number=w28)
        Is Less(x=w28, y=s5) -> w29
        case (w29) {
          frame False, Default {
            w7 = s5
          }
          frame True {
            w7 = w28
          }
        }
        Floating Point String To Number(string=w19, use system decimal point (T)=TRUE) -> (number=w30)
        Is Less(x=w30, y=s6) -> w31
        case (w31) {
          frame False, Default {
            w3 = s6
          }
          frame True {
            w3 = w30
          }
        }
        call "Maximum_Left.gviweb"()
      }
    }
    next s1 = w6
    next s2 = w5
    next s3 = w2
    next s4 = w4
    next s5 = w7
    next s6 = w3
  }
  Insert Into Array(inArray=f64[] [], new=s1, new=s2, new=s3, new=s4, new=s5, new=s6) -> w32
  $"minimum Angles" <- w32
