vi "Minimum_PCB.gviweb"   [G Web Development Software 22.3.0]
inputs:
  "Temperature sensors": T1[]
outputs:
  "minimum left": f64[]
types:
  T1 = cluster{"Timestamp": string, "CPU": string, "IO": string}
diagram:
  s1 = 0  # shift register
  s2 = 0  # shift register
  for (iteration -> i1) {
    w1 = each element of $"Temperature sensors"
    case (i1) {
      frame 0 {
        Property Node(instance in=w1) -> ("CPU"=w4, "IO"=w5)
        Floating Point String To Number(string=w4, use system decimal point (T)=TRUE) -> (number=w3)
        Floating Point String To Number(string=w5, use system decimal point (T)=TRUE) -> (number=w2)
      }
      frame 1, Default {
        Property Node(instance in=w1) -> ("CPU"=w6, "IO"=w7)
        Floating Point String To Number(string=w6, use system decimal point (T)=TRUE) -> (number=w8)
        Is Less(x=w8, y=s1) -> w9
        case (w9) {
          frame False, Default {
            w3 = s1
          }
          frame True {
            w3 = w8
          }
        }
        Floating Point String To Number(string=w7, use system decimal point (T)=TRUE) -> (number=w10)
        Is Less(x=w10, y=s2) -> w11
        case (w11) {
          frame False, Default {
            w2 = s2
          }
          frame True {
            w2 = w10
          }
        }
      }
    }
    next s1 = w3
    next s2 = w2
  }
  Insert Into Array(inArray=f64[] [], new=s1, new=s2) -> w12
  $"minimum left" <- w12
