vi "Minimum_Pressure_Left.gviweb"   [G Web Development Software 22.3.0]
inputs:
  "Left side pressure Pressure Left": T1[]
outputs:
  "minimum Angles": f64[]
types:
  T1 = cluster{"Timestamp": string, "Pressure_offset/ Left": string, "Pressure_offset_date/ Left": string, "Pressure_offset_time/ Left": string, "Pressure_phase/ Left": string, "P1_absolute": string, "P1_relative": string, "P3_I/O_pressure": string, "Pressure_in_pan/ Left": string}
diagram:
  s1 = 0  # shift register
  s2 = 0  # shift register
  s3 = 0  # shift register
  s4 = 0  # shift register
  for (iteration -> i1) {
    w1 = each element of $"Left side pressure Pressure Left"
    case (i1) {
      frame 0 {
        Property Node(instance in=w1) -> ("P1_absolute"=w6, "P1_relative"=w7, "P3_I/O_pressure"=w8, "Pressure_in_pan/ Left"=w9)
        Floating Point String To Number(string=w6, use system decimal point (T)=TRUE) -> (number=w5)
        Floating Point String To Number(string=w7, use system decimal point (T)=TRUE) -> (number=w4)
        Floating Point String To Number(string=w8, use system decimal point (T)=TRUE) -> (number=w2)
        Floating Point String To Number(string=w9, use system decimal point (T)=TRUE) -> (number=w3)
      }
      frame 1, Default {
        Property Node(instance in=w1) -> ("P1_absolute"=w10, "P1_relative"=w11, "P3_I/O_pressure"=w12, "Pressure_in_pan/ Left"=w13)
        Floating Point String To Number(string=w10, use system decimal point (T)=TRUE) -> (number=w14)
        Is Less(x=w14, y=s1) -> w15
        case (w15) {
          frame False, Default {
            w5 = s1
          }
          frame True {
            w5 = w14
          }
        }
        Floating Point String To Number(string=w11, use system decimal point (T)=TRUE) -> (number=w16)
        Is Less(x=w16, y=s2) -> w17
        case (w17) {
          frame False, Default {
            w4 = s2
          }
          frame True {
            w4 = w16
          }
        }
        Floating Point String To Number(string=w12, use system decimal point (T)=TRUE) -> (number=w18)
        Is Less(x=w18, y=s3) -> w19
        case (w19) {
          frame False, Default {
            w2 = s3
          }
          frame True {
            w2 = w18
          }
        }
        Floating Point String To Number(string=w13, use system decimal point (T)=TRUE) -> (number=w20)
        Is Less(x=w20, y=s4) -> w21
        case (w21) {
          frame False, Default {
            w3 = s4
          }
          frame True {
            w3 = w20
          }
        }
      }
    }
    next s1 = w5
    next s2 = w4
    next s3 = w2
    next s4 = w3
  }
  Insert Into Array(inArray=f64[] [], new=s1, new=s2, new=s3, new=s4) -> w22
  $"minimum Angles" <- w22
