vi "Minimum_Pressure_Right.gviweb"   [G Web Development Software 22.3.0]
inputs:
  "Right side pressure data": T1[]
outputs:
  "minimum Angles": f64[]
types:
  T1 = cluster{"Timestamp": string, "P2_absolute": string, "P2_relative": string, "Pressure_in_pan/ Right": string, "Right_pressure_offset": string, "Right_pressure_offset_date": string, "Right_pressure_offset_time": string, "Pressure_phase/ Right": string}
diagram:
  s1 = 0  # shift register
  s2 = 0  # shift register
  s3 = 0  # shift register
  for (iteration -> i1) {
    w1 = each element of $"Right side pressure data"
    case (i1) {
      frame 0 {
        Property Node(instance in=w1) -> ("P2_absolute"=w5, "P2_relative"=w6, "Pressure_in_pan/ Right"=w7)
        Floating Point String To Number(string=w5, use system decimal point (T)=TRUE) -> (number=w4)
        Floating Point String To Number(string=w6, use system decimal point (T)=TRUE) -> (number=w3)
        Floating Point String To Number(string=w7, use system decimal point (T)=TRUE) -> (number=w2)
      }
      frame 1, Default {
        Property Node(instance in=w1) -> ("P2_absolute"=w8, "P2_relative"=w9, "Pressure_in_pan/ Right"=w10)
        Floating Point String To Number(string=w8, use system decimal point (T)=TRUE) -> (number=w11)
        Is Less(x=w11, y=s1) -> w12
        case (w12) {
          frame False, Default {
            w4 = s1
          }
          frame True {
            w4 = w11
          }
        }
        Floating Point String To Number(string=w9, use system decimal point (T)=TRUE) -> (number=w13)
        Is Less(x=w13, y=s2) -> w14
        case (w14) {
          frame False, Default {
            w3 = s2
          }
          frame True {
            w3 = w13
          }
        }
        Floating Point String To Number(string=w10, use system decimal point (T)=TRUE) -> (number=w15)
        Is Less(x=w15, y=s3) -> w16
        case (w16) {
          frame False, Default {
            w2 = s3
          }
          frame True {
            w2 = w15
          }
        }
      }
    }
    next s1 = w4
    next s2 = w3
    next s3 = w2
  }
  Insert Into Array(inArray=f64[] [], new=s1, new=s2, new=s3) -> w17
  $"minimum Angles" <- w17
