vi "Minimum_Temp_Right.gviweb"   [G Web Development Software 22.3.0]
inputs:
  "Temperature sensors": T1[]
outputs:
  "minimum right": f64[]
types:
  T1 = cluster{"Timestamp": string, "B107": string, "B108": string, "B109": string, "B110": string, "B111": string, "B112": string, "B211": string, "B311": string, "B312": string, "B313": string, "B314": string, "B315": string, "B316": string}
diagram:
  s1 = 0  # shift register
  s2 = 0  # shift register
  s3 = 0  # shift register
  s4 = 0  # shift register
  s5 = 0  # shift register
  s6 = 0  # shift register
  s7 = 0  # shift register
  s8 = uninitialised  # shift register
  s9 = 0  # shift register
  s10 = 0  # shift register
  s11 = 0  # shift register
  s12 = 0  # shift register
  s13 = 0  # shift register
  for (iteration -> i1) {
    w1 = each element of $"Temperature sensors"
    case (i1) {
      frame 0 {
        Property Node(instance in=w1) -> ("B107"=w15, "B108"=w16, "B109"=w17, "B110"=w18, "B111"=w19, "B112"=w20, "B211"=w21, "B311"=w22, "B312"=w23, "B313"=w24, "B314"=w25, "B315"=w26, "B316"=w27)
        Floating Point String To Number(string=w15, use system decimal point (T)=TRUE) -> (number=w10)
        Floating Point String To Number(string=w16, use system decimal point (T)=TRUE) -> (number=w8)
        Floating Point String To Number(string=w17, use system decimal point (T)=TRUE) -> (number=w3)
        Floating Point String To Number(string=w18, use system decimal point (T)=TRUE) -> (number=w5)
        Floating Point String To Number(string=w19, use system decimal point (T)=TRUE) -> (number=w11)
        Floating Point String To Number(string=w20, use system decimal point (T)=TRUE) -> (number=w4)
        Floating Point String To Number(string=w21, use system decimal point (T)=TRUE) -> (number=w6)
        Floating Point String To Number(string=w22, use system decimal point (T)=TRUE) -> (number=w7)
        Floating Point String To Number(string=w23, use system decimal point (T)=TRUE) -> (number=w9)
        Floating Point String To Number(string=w24, use system decimal point (T)=TRUE) -> (number=w2)
        Floating Point String To Number(string=w25, use system decimal point (T)=TRUE) -> (number=w14)
        Floating Point String To Number(string=w26, use system decimal point (T)=TRUE) -> (number=w13)
        Floating Point String To Number(string=w27, use system decimal point (T)=TRUE) -> (number=w12)
      }
      frame 1, Default {
        Property Node(instance in=w1) -> ("B107"=w28, "B108"=w29, "B109"=w30, "B110"=w31, "B111"=w32, "B112"=w33, "B211"=w34, "B311"=w35, "B312"=w36, "B313"=w37, "B314"=w38, "B315"=w39, "B316"=w40)
        Floating Point String To Number(string=w28, use system decimal point (T)=TRUE) -> (number=w41)
        Is Less(x=w41, y=s1) -> w42
        case (w42) {
          frame False, Default {
            w10 = s1
          }
          frame True {
            w10 = w41
          }
        }
        Floating Point String To Number(string=w29, use system decimal point (T)=TRUE) -> (number=w43)
        Is Less(x=w43, y=s2) -> w44
        case (w44) {
          frame False, Default {
            w8 = s2
          }
          frame True {
            w8 = w43
          }
        }
        Floating Point String To Number(string=w30, use system decimal point (T)=TRUE) -> (number=w45)
        Is Less(x=w45, y=s3) -> w46
        case (w46) {
          frame False, Default {
            w3 = s3
          }
          frame True {
            w3 = w45
          }
        }
        Floating Point String To Number(string=w31, use system decimal point (T)=TRUE) -> (number=w47)
        Is Less(x=w47, y=s4) -> w48
        case (w48) {
          frame False, Default {
            w5 = s4
          }
          frame True {
            w5 = w47
          }
        }
        Floating Point String To Number(string=w32, use system decimal point (T)=TRUE) -> (number=w49)
        Is Less(x=w49, y=s5) -> w50
        case (w50) {
          frame False, Default {
            w11 = s5
          }
          frame True {
            w11 = w49
          }
        }
        Floating Point String To Number(string=w33, use system decimal point (T)=TRUE) -> (number=w51)
        Is Less(x=w51, y=s6) -> w52
        case (w52) {
          frame False, Default {
            w4 = s6
          }
          frame True {
            w4 = w51
          }
        }
        Floating Point String To Number(string=w34, use system decimal point (T)=TRUE) -> (number=w53)
        Is Less(x=w53, y=s7) -> w54
        case (w54) {
          frame False, Default {
            w6 = s7
          }
          frame True {
            w6 = w53
          }
        }
        Floating Point String To Number(string=w35, use system decimal point (T)=TRUE) -> (number=w55)
        Is Less(x=w55, y=s8) -> w56
        case (w56) {
          frame False, Default {
            w7 = s8
          }
          frame True {
            w7 = w55
          }
        }
        Floating Point String To Number(string=w36, use system decimal point (T)=TRUE) -> (number=w57)
        Is Less(x=w57, y=s9) -> w58
        case (w58) {
          frame False, Default {
            w9 = s9
          }
          frame True {
            w9 = w57
          }
        }
        Floating Point String To Number(string=w37, use system decimal point (T)=TRUE) -> (number=w59)
        Is Less(x=w59, y=s10) -> w60
        case (w60) {
          frame False, Default {
            w2 = s10
          }
          frame True {
            w2 = w59
          }
        }
        Floating Point String To Number(string=w38, use system decimal point (T)=TRUE) -> (number=w61)
        Is Less(x=w61, y=s11) -> w62
        case (w62) {
          frame False, Default {
            w14 = s11
          }
          frame True {
            w14 = w61
          }
        }
        Floating Point String To Number(string=w39, use system decimal point (T)=TRUE) -> (number=w63)
        Is Less(x=w63, y=s12) -> w64
        case (w64) {
          frame False, Default {
            w13 = s12
          }
          frame True {
            w13 = w63
          }
        }
        Floating Point String To Number(string=w40, use system decimal point (T)=TRUE) -> (number=w65)
        Is Less(x=w65, y=s13) -> w66
        case (w66) {
          frame False, Default {
            w12 = s13
          }
          frame True {
            w12 = w65
          }
        }
      }
    }
    next s1 = w10
    next s2 = w8
    next s3 = w3
    next s4 = w5
    next s5 = w11
    next s6 = w4
    next s7 = w6
    next s8 = w7
    next s9 = w9
    next s10 = w2
    next s11 = w14
    next s12 = w13
    next s13 = w12
  }
  Insert Into Array(inArray=f64[] [], new=s1, new=s2, new=s3, new=s4, new=s5, new=s6, new=s7, new=s8, new=s9, new=s10, new=s11, new=s12, new=s13) -> w67
  $"minimum right" <- w67
