vi "Motors.gviweb"   [G Web Development Software 22.3.0]
inputs:
  "Motors array": string[]
  "Intput": error
outputs:
  "Motors": T1[]
  "Output": error
types:
  T1 = cluster{"Timestamp": string, "Left Rahrbach locking": string, "Left Rahrbach unlocking": string, "M10": string, "M2": string, "M4": string, "M4-S1": string, "M4-S2-S6": string, "M4-S3": string, "M6": string, "M8": string, "M8-S1": string, "M8-S2-S6": string, "M8-S3": string, "Right Rahrbach locking": string, "Right Rahrbach unlocking": string}
uses:
  WebApp::Read_XML_array.gviweb
diagram:
  w1 = T1 {all zero or empty}  # Cluster Constant
  # "Left Rahrbach locking", "Left Rahrbach unlocking", "M10", "M2", "M4", "M4-S1", "M4-S2-S6", "M4-S3", "M6", "M8", "M8-S1", "M8-S2-S6", "M8-S3", "Right Rahrbach locking", "Right Rahrbach unlocking"
  s1 = T1[] []  # shift register
  for (iteration -> i1) {
    w2 = each element of $"Motors array"
    call "Read_XML_array.gviweb"(Input XML=w2, Error in=$Intput) -> (Output XML array=w3, Error out=w4)
    case (i1) {
      frame 0 {
        for {
          w6 = each element of w3
          Match Pattern(regular expression="=\"", string=w6) -> (after substring=w7)
          Match Pattern(regular expression="\">", string=w7) -> (after substring=w8, before substring=w9)
          Match Pattern(regular expression="</", string=w8) -> (before substring=w10)
          String Subset(length (rest)=2, string=w9) -> w11
          String Subset(length (rest)=2, offset (0)=2, string=w9) -> w12
          String Subset(offset (0)=4, string=w9) -> w13
          Concatenate Strings(w11, ":", w12, ":", w13) -> w14
          Property Node(instance in=w1, "Timestamp"=w14, "Left Rahrbach locking"=w10) -> (instance out=w15)
          append w15 to w5
        }
      }
      frame 1 {
        for {
          w16 = each element of w3
          Match Pattern(regular expression="=\"", string=w16) -> (after substring=w18)
          Match Pattern(regular expression="\">", string=w18) -> (after substring=w19)
          Match Pattern(regular expression="</", string=w19) -> (before substring=w20)
          Property Node(instance in=w1, "Left Rahrbach unlocking"=w20) -> (instance out=w21)
          append w21 to w17
        }
        for {
          w22 = each element of s1
          w23 = each element of w17
          Property Node(instance in=w23) -> ("Left Rahrbach unlocking"=w24)
          Property Node(instance in=w22, "Left Rahrbach unlocking"=w24) -> (instance out=w25)
          append w25 to w5
        }
      }
      frame 2 {
        for {
          w26 = each element of w3
          Match Pattern(regular expression="=\"", string=w26) -> (after substring=w28)
          Match Pattern(regular expression="\">", string=w28) -> (after substring=w29)
          Match Pattern(regular expression="</", string=w29) -> (before substring=w30)
          Property Node(instance in=w1, "M10"=w30) -> (instance out=w31)
          append w31 to w27
        }
        for {
          w32 = each element of s1
          w33 = each element of w27
          Property Node(instance in=w33) -> ("M10"=w34)
          Property Node(instance in=w32, "M10"=w34) -> (instance out=w35)
          append w35 to w5
        }
      }
      frame 3 {
        for {
          w36 = each element of w3
          Match Pattern(regular expression="=\"", string=w36) -> (after substring=w38)
          Match Pattern(regular expression="\">", string=w38) -> (after substring=w39)
          Match Pattern(regular expression="</", string=w39) -> (before substring=w40)
          Property Node(instance in=w1, "M2"=w40) -> (instance out=w41)
          append w41 to w37
        }
        for {
          w42 = each element of s1
          w43 = each element of w37
          Property Node(instance in=w43) -> ("M2"=w44)
          Property Node(instance in=w42, "M2"=w44) -> (instance out=w45)
          append w45 to w5
        }
      }
      frame 4 {
        for {
          w46 = each element of w3
          Match Pattern(regular expression="=\"", string=w46) -> (after substring=w48)
          Match Pattern(regular expression="\">", string=w48) -> (after substring=w49)
          Match Pattern(regular expression="</", string=w49) -> (before substring=w50)
          Property Node(instance in=w1, "M4"=w50) -> (instance out=w51)
          append w51 to w47
        }
        for {
          w52 = each element of s1
          w53 = each element of w47
          Property Node(instance in=w53) -> ("M4"=w54)
          Property Node(instance in=w52, "M4"=w54) -> (instance out=w55)
          append w55 to w5
        }
      }
      frame 5 {
        for {
          w56 = each element of w3
          Match Pattern(regular expression="=\"", string=w56) -> (after substring=w58)
          Match Pattern(regular expression="\">", string=w58) -> (after substring=w59)
          Match Pattern(regular expression="</", string=w59) -> (before substring=w60)
          Property Node(instance in=w1, "M4-S1"=w60) -> (instance out=w61)
          append w61 to w57
        }
        for {
          w62 = each element of s1
          w63 = each element of w57
          Property Node(instance in=w63) -> ("M4-S1"=w64)
          Property Node(instance in=w62, "M4-S1"=w64) -> (instance out=w65)
          append w65 to w5
        }
      }
      frame 6 {
        for {
          w66 = each element of w3
          Match Pattern(regular expression="=\"", string=w66) -> (after substring=w68)
          Match Pattern(regular expression="\">", string=w68) -> (after substring=w69)
          Match Pattern(regular expression="</", string=w69) -> (before substring=w70)
          Property Node(instance in=w1, "M4-S2-S6"=w70) -> (instance out=w71)
          append w71 to w67
        }
        for {
          w72 = each element of s1
          w73 = each element of w67
          Property Node(instance in=w73) -> ("M4-S2-S6"=w74)
          Property Node(instance in=w72, "M4-S2-S6"=w74) -> (instance out=w75)
          append w75 to w5
        }
      }
      frame 7 {
        for {
          w76 = each element of w3
          Match Pattern(regular expression="=\"", string=w76) -> (after substring=w78)
          Match Pattern(regular expression="\">", string=w78) -> (after substring=w79)
          Match Pattern(regular expression="</", string=w79) -> (before substring=w80)
          Property Node(instance in=w1, "M4-S3"=w80) -> (instance out=w81)
          append w81 to w77
        }
        for {
          w82 = each element of s1
          w83 = each element of w77
          Property Node(instance in=w83) -> ("M4-S3"=w84)
          Property Node(instance in=w82, "M4-S3"=w84) -> (instance out=w85)
          append w85 to w5
        }
      }
      frame 8 {
        for {
          w86 = each element of w3
          Match Pattern(regular expression="=\"", string=w86) -> (after substring=w88)
          Match Pattern(regular expression="\">", string=w88) -> (after substring=w89)
          Match Pattern(regular expression="</", string=w89) -> (before substring=w90)
          Property Node(instance in=w1, "M6"=w90) -> (instance out=w91)
          append w91 to w87
        }
        for {
          w92 = each element of s1
          w93 = each element of w87
          Property Node(instance in=w93) -> ("M6"=w94)
          Property Node(instance in=w92, "M6"=w94) -> (instance out=w95)
          append w95 to w5
        }
      }
      frame 9 {
        for {
          w96 = each element of w3
          Match Pattern(regular expression="=\"", string=w96) -> (after substring=w98)
          Match Pattern(regular expression="\">", string=w98) -> (after substring=w99)
          Match Pattern(regular expression="</", string=w99) -> (before substring=w100)
          Property Node(instance in=w1, "M8"=w100) -> (instance out=w101)
          append w101 to w97
        }
        for {
          w102 = each element of s1
          w103 = each element of w97
          Property Node(instance in=w103) -> ("M8"=w104)
          Property Node(instance in=w102, "M8"=w104) -> (instance out=w105)
          append w105 to w5
        }
      }
      frame 10 {
        for {
          w106 = each element of w3
          Match Pattern(regular expression="=\"", string=w106) -> (after substring=w108)
          Match Pattern(regular expression="\">", string=w108) -> (after substring=w109)
          Match Pattern(regular expression="</", string=w109) -> (before substring=w110)
          Property Node(instance in=w1, "M8-S1"=w110) -> (instance out=w111)
          append w111 to w107
        }
        for {
          w112 = each element of s1
          w113 = each element of w107
          Property Node(instance in=w113) -> ("M8-S1"=w114)
          Property Node(instance in=w112, "M8-S1"=w114) -> (instance out=w115)
          append w115 to w5
        }
      }
      frame 11 {
        for {
          w116 = each element of w3
          Match Pattern(regular expression="=\"", string=w116) -> (after substring=w118)
          Match Pattern(regular expression="\">", string=w118) -> (after substring=w119)
          Match Pattern(regular expression="</", string=w119) -> (before substring=w120)
          Property Node(instance in=w1, "M8-S2-S6"=w120) -> (instance out=w121)
          append w121 to w117
        }
        for {
          w122 = each element of s1
          w123 = each element of w117
          Property Node(instance in=w123) -> ("M8-S2-S6"=w124)
          Property Node(instance in=w122, "M8-S2-S6"=w124) -> (instance out=w125)
          append w125 to w5
        }
      }
      frame 12 {
        for {
          w126 = each element of w3
          Match Pattern(regular expression="=\"", string=w126) -> (after substring=w128)
          Match Pattern(regular expression="\">", string=w128) -> (after substring=w129)
          Match Pattern(regular expression="</", string=w129) -> (before substring=w130)
          Property Node(instance in=w1, "M8-S3"=w130) -> (instance out=w131)
          append w131 to w127
        }
        for {
          w132 = each element of s1
          w133 = each element of w127
          Property Node(instance in=w133) -> ("M8-S3"=w134)
          Property Node(instance in=w132, "M8-S3"=w134) -> (instance out=w135)
          append w135 to w5
        }
      }
      frame 13 {
        for {
          w136 = each element of w3
          Match Pattern(regular expression="=\"", string=w136) -> (after substring=w138)
          Match Pattern(regular expression="\">", string=w138) -> (after substring=w139)
          Match Pattern(regular expression="</", string=w139) -> (before substring=w140)
          Property Node(instance in=w1, "Right Rahrbach locking"=w140) -> (instance out=w141)
          append w141 to w137
        }
        for {
          w142 = each element of s1
          w143 = each element of w137
          Property Node(instance in=w143) -> ("Right Rahrbach locking"=w144)
          Property Node(instance in=w142, "Right Rahrbach locking"=w144) -> (instance out=w145)
          append w145 to w5
        }
      }
      frame 14, Default {
        for {
          w146 = each element of w3
          Match Pattern(regular expression="=\"", string=w146) -> (after substring=w148)
          Match Pattern(regular expression="\">", string=w148) -> (after substring=w149)
          Match Pattern(regular expression="</", string=w149) -> (before substring=w150)
          Property Node(instance in=w1, "Right Rahrbach unlocking"=w150) -> (instance out=w151)
          append w151 to w147
        }
        for {
          w152 = each element of s1
          w153 = each element of w147
          Property Node(instance in=w153) -> ("Right Rahrbach unlocking"=w154)
          Property Node(instance in=w152, "Right Rahrbach unlocking"=w154) -> (instance out=w155)
          append w155 to w5
        }
      }
    }
    next s1 = w5
  }
  $Motors <- s1
  $Output <- w4
