vi "Order_Sensors_infos.gviweb"   [G Web Development Software 22.3.0]
inputs:
  "Error Input": error
  "Input XML array": string[]
  "Device Type": string
outputs:
  "Temperature sensors Left": string[]
  "Error Output": error
  "SSR Commands": string[]
  "Pans charge": string[]
  "PCB Temperatures": string[]
  "Left side pressure data": string[]
  "Right side pressure data": string[]
  "Microswitch": string[]
  "Temperature sensors right": string[]
diagram:
  $"Error Output" <- $"Error Input"
  for {
    w1 = each element of $"Input XML array"
    Match Pattern(regular expression="<Name>", string=w1) -> (after substring=w4)
    Match Pattern(regular expression="</Name>", string=w4) -> (after substring=w5, before substring=w6)
    append w6 to w2
    append w5 to w3
  }
  # Temperature sensors:
  # B201, B211, B101, B102, B103, B104, B105, B106, B107, B108, B109, B110, B111, B112, B113, B114, B115, B116, B117, B118, B301, B302, B303, B304, B305, B306, B311, B312, B313, B314, B315, B316
  #
  # SSR Commands:
  # R101, R102, R103, R104, R105, R106, R107, R108, R109, R110, R111, R112, R113, R114, R115, R116, R117, R118
  #
  # Pans charge (count of recipes launched on the device):
  # Charge Left, Charge Right
  #
  # PCB Temperatures:
  # CPU_Temp, IO_Temp
  #
  # Left side pressure data:
  # P3_I/O_pressure, P1_absolute, P1_relative, Left_pressure_offset, Left_pressure_offset_time, Left_pressure_offset_date, Pressure_phase, Left_pressure_phase, Pressure_in_pan_left
  #
  # Right side pressure data:
  # "Right_pressure_offset", "Right_pressure_offset_date", "Right_pressure_offset_time", "Right_pressure_phase", "P2_absolute", "P2_relative", "Pressure_in_pan_right", "Right_pressure_phase"
  #
  # Microswitch:
  # S11, S111, S12, S13, Safety Chain Voltage
  #
  # Valves:
  # Right AZ Valve command request, Y1, Y2, Y3, Y4, Y4 Close
  # "B101", "B102", "B103", "B104", "B105", "B106", "B201", "B301", "B302", "B303", "B304", "B305", "B306"
  # "B107", "B108", "B109", "B110", "B111", "B112", "B211", "B311", "B312", "B313", "B314", "B315", "B316"
  s1 = string[] []  # shift register
  s2 = string[] []  # shift register
  s3 = string[] []  # shift register
  s4 = string[] []  # shift register
  s5 = string[] []  # shift register
  s6 = string[] []  # shift register
  s7 = string[] []  # shift register
  s8 = string[] []  # shift register
  for {
    w7 = each element of w3
    w8 = each element of w2
    case ($"Device Type") {
      frame "2S", "2S-P" {
        case (w8) {
          frame "False", Default {
            w15 = s1
            w14 = s2
            w13 = s3
            w12 = s4
            w10 = s5
            w11 = s6
            w9 = s7
            w16 = s8
          }
          frame "S11", "S111", "S12", "S13", "Safety Chain Voltage" {
            Insert Into Array(inArray=s7, new=w7) -> w9
            w15 = s1
            w14 = s2
            w13 = s3
            w12 = s4
            w10 = s5
            w11 = s6
            w16 = s8
          }
          frame "P2_absolute", "P2_relative", "Pressure_in_pan_right", "Right_pressure_offset", "Right_pressure_offset_date", "Right_pressure_offset_time", "Right_pressure_phase" {
            Insert Into Array(inArray=s6, new=w7) -> w11
            w15 = s1
            w14 = s2
            w13 = s3
            w12 = s4
            w10 = s5
            w9 = s7
            w16 = s8
          }
          frame "Left_pressure_offset", "Left_pressure_offset_date", "Left_pressure_offset_time", "Left_pressure_phase", "P1_absolute", "P1_relative", "P3_I/O_pressure", "Pressure_in_pan_left", "Pressure_phase" {
            Insert Into Array(inArray=s5, new=w7) -> w10
            w15 = s1
            w14 = s2
            w13 = s3
            w12 = s4
            w11 = s6
            w9 = s7
            w16 = s8
          }
          frame "CPU_Temp", "IO_Temp" {
            Insert Into Array(inArray=s4, new=w7) -> w12
            w15 = s1
            w14 = s2
            w13 = s3
            w10 = s5
            w11 = s6
            w9 = s7
            w16 = s8
          }
          frame "Charge Left", "Charge Right" {
            Insert Into Array(inArray=s3, new=w7) -> w13
            w15 = s1
            w14 = s2
            w12 = s4
            w10 = s5
            w11 = s6
            w9 = s7
            w16 = s8
          }
          frame "B101", "B102", "B103", "B104", "B105", "B106", "B201", "B301", "B302", "B303", "B304", "B305", "B306" {
            Concatenate Strings(w8, "\r\n", w7) -> w17
            Insert Into Array(inArray=s1, new=w17) -> w15
            w14 = s2
            w13 = s3
            w12 = s4
            w10 = s5
            w11 = s6
            w9 = s7
            w16 = s8
          }
          frame "B107", "B108", "B109", "B110", "B111", "B112", "B211", "B311", "B312", "B313", "B314", "B315", "B316" {
            Concatenate Strings(w8, "\r\n", w7) -> w18
            Insert Into Array(inArray=s8, new=w18) -> w16
            w15 = s1
            w14 = s2
            w13 = s3
            w12 = s4
            w10 = s5
            w11 = s6
            w9 = s7
          }
          frame "R101", "R102", "R103", "R104", "R105", "R106", "R107", "R108", "R109", "R110", "R111", "R112", "R113", "R114", "R115", "R116", "R117", "R118" {
            Insert Into Array(inArray=s2, new=w7) -> w14
            w15 = s1
            w13 = s3
            w12 = s4
            w10 = s5
            w11 = s6
            w9 = s7
            w16 = s8
          }
        }
      }
      frame "false", Default {
        case (w8) {
          frame "False", Default {
            w15 = s1
            w14 = s2
            w13 = s3
            w12 = s4
            w10 = s5
            w11 = s6
            w9 = s7
          }
          frame "S11", "S111", "S12", "S13", "Safety Chain Voltage" {
            Insert Into Array(inArray=s7, new=w7) -> w9
            w15 = s1
            w14 = s2
            w13 = s3
            w12 = s4
            w10 = s5
            w11 = s6
          }
          frame "P2_absolute", "P2_relative", "Pressure_in_pan_right", "Right_pressure_offset", "Right_pressure_offset_date", "Right_pressure_offset_time", "Right_pressure_phase" {
            Insert Into Array(inArray=s6, new=w7) -> w11
            w15 = s1
            w14 = s2
            w13 = s3
            w12 = s4
            w10 = s5
            w9 = s7
          }
          frame "Left_pressure_offset", "Left_pressure_offset_date", "Left_pressure_offset_time", "Left_pressure_phase", "P1_absolute", "P1_relative", "P3_I/O_pressure", "Pressure_in_pan_left", "Pressure_phase" {
            Insert Into Array(inArray=s5, new=w7) -> w10
            w15 = s1
            w14 = s2
            w13 = s3
            w12 = s4
            w11 = s6
            w9 = s7
          }
          frame "CPU_Temp", "IO_Temp" {
            Insert Into Array(inArray=s4, new=w7) -> w12
            w15 = s1
            w14 = s2
            w13 = s3
            w10 = s5
            w11 = s6
            w9 = s7
          }
          frame "Charge Left", "Charge Right" {
            Insert Into Array(inArray=s3, new=w7) -> w13
            w15 = s1
            w14 = s2
            w12 = s4
            w10 = s5
            w11 = s6
            w9 = s7
          }
          frame "B101", "B102", "B103", "B104", "B105", "B106", "B107", "B108", "B109", "B110", "B111", "B112", "B113", "B114", "B115", "B116", "B117", "B118", "B201", "B211", "B301", "B302", "B303", "B304", "B305", "B306", "B311", "B312", "B313", "B314", "B315", "B316" {
            Concatenate Strings(w8, "\r\n", w7) -> w19
            Insert Into Array(inArray=s1, new=w19) -> w15
            w14 = s2
            w13 = s3
            w12 = s4
            w10 = s5
            w11 = s6
            w9 = s7
          }
          frame "R101", "R102", "R103", "R104", "R105", "R106", "R107", "R108", "R109", "R110", "R111", "R112", "R113", "R114", "R115", "R116", "R117", "R118" {
            Insert Into Array(inArray=s2, new=w7) -> w14
            w15 = s1
            w13 = s3
            w12 = s4
            w10 = s5
            w11 = s6
            w9 = s7
          }
        }
        w16 = s8
      }
    }
    next s1 = w15
    next s2 = w14
    next s3 = w13
    next s4 = w12
    next s5 = w10
    next s6 = w11
    next s7 = w9
    next s8 = w16
  }
  $"PCB Temperatures" <- s4
  $"Left side pressure data" <- s5
  $"Temperature sensors Left" <- s1
  $"SSR Commands" <- s2
  $"Pans charge" <- s3
  $"Right side pressure data" <- s6
  $Microswitch <- s7
  $"Temperature sensors right" <- s8
