vi "Order_Sensors_infos_Part2.gviweb"   [G Web Development Software 22.3.0]
inputs:
  "Error Input": error
  "Input XML array": string[]
outputs:
  "Motors": string[]
  "Error Output": error
  "Valves": string[]
  "Angles": string[]
diagram:
  $"Error Output" <- $"Error Input"
  # Valves:
  #
  # "Right AZ Valve command request", "Y1", "Y2", "Y3", "Y4", "Y4 Close", "Y4 open", "Y5", "Y5 close", "Y5 open"
  #
  #
  # Motoren:
  #
  #
  # "Left Rahrbach locking", "Left Rahrbach unlocking", "M10", "M2", "M4", "M4-S1", "M4-S2-S6", "M4-S3", "M6", "M8", "M8-S1", "M8-S2-S6", "M8-S3", "Right Rahrbach locking", "Right Rahrbach unlocking"
  #
  # Angles:
  #
  # pt1, pt1[ang]_lid, pt1[ang]_pan, pt2, pt2[ang]_lid, pt2[ang]_pan
  for {
    w1 = each element of $"Input XML array"
    Match Pattern(regular expression="<Name>", string=w1) -> (after substring=w4)
    Match Pattern(regular expression="</Name>", string=w4) -> (after substring=w5, before substring=w6)
    append w6 to w2
    append w5 to w3
  }
  s1 = string[] []  # shift register
  s2 = string[] []  # shift register
  s3 = string[] []  # shift register
  for {
    w7 = each element of w3
    w8 = each element of w2
    case (w8) {
      frame "False", Default {
        w9 = s1
        w10 = s2
        w11 = s3
      }
      frame "pt1", "pt1[ang]_lid", "pt1[ang]_pan", "pt2", "pt2[ang]_lid", "pt2[ang]_pan" {
        Insert Into Array(inArray=s3, new=w7) -> w11
        w9 = s1
        w10 = s2
      }
      frame "Left Rahrbach locking", "Left Rahrbach unlocking", "M10", "M2", "M4", "M4-S1", "M4-S2-S6", "M4-S3", "M6", "M8", "M8-S1", "M8-S2-S6", "M8-S3", "Right Rahrbach locking", "Right Rahrbach unlocking" {
        Insert Into Array(inArray=s2, new=w7) -> w10
        w9 = s1
        w11 = s3
      }
      frame "Right AZ Valve command request", "Y1", "Y2", "Y3", "Y4", "Y4 Close", "Y4 close", "Y4 open", "Y5", "Y5 close", "Y5 open" {
        Insert Into Array(inArray=s1, new=w7) -> w9
        w10 = s2
        w11 = s3
      }
    }
    next s1 = w9
    next s2 = w10
    next s3 = w11
  }
  $Valves <- s1
  $Motors <- s2
  $Angles <- s3
