vi "PCB Temperatures.gviweb"   [G Web Development Software 22.3.0]
inputs:
  "PCB Temperatures array": string[]
  "Intput": error
outputs:
  "PCB Temperatures": T1[]
  "Output": error
types:
  T1 = cluster{"Timestamp": string, "Charge Left": string, "Charge Right": string}
  T2 = cluster{"Timestamp": string, "CPU_Temp": string, "IO_Temp": string}
uses:
  WebApp::Read_XML_array.gviweb
diagram:
  w1 = T2 {all zero or empty}  # Cluster Constant
  s1 = T2[] []  # shift register
  for (iteration -> i1) {
    w2 = each element of $"PCB Temperatures array"
    call "Read_XML_array.gviweb"(Input XML=w2, Error in=$Intput) -> (Output XML array=w3, Error out=w4)
    case (i1) {
      frame 0 {
        for {
          w6 = each element of w3
          Match Pattern(regular expression="=\"", string=w6) -> (after substring=w7)
          Match Pattern(regular expression="\">", string=w7) -> (after substring=w8, before substring=w9)
          Match Pattern(regular expression="</", string=w8) -> (before substring=w10)
          String Subset(length (rest)=2, string=w9) -> w11
          String Subset(length (rest)=2, offset (0)=2, string=w9) -> w12
          String Subset(offset (0)=4, string=w9) -> w13
          Concatenate Strings(w11, ":", w12, ":", w13) -> w14
          Property Node(instance in=w1, "Timestamp"=w14, "CPU_Temp"=w10) -> (instance out=w15)
          append w15 to w5
        }
      }
      frame 1, Default {
        for {
          w16 = each element of w3
          Match Pattern(regular expression="=\"", string=w16) -> (after substring=w18)
          Match Pattern(regular expression="\">", string=w18) -> (after substring=w19)
          Match Pattern(regular expression="</", string=w19) -> (before substring=w20)
          Property Node(instance in=w1, "IO_Temp"=w20) -> (instance out=w21)
          append w21 to w17
        }
        for {
          w22 = each element of s1
          w23 = each element of w17
          Property Node(instance in=w23) -> ("IO_Temp"=w24)
          Property Node(instance in=w22, "IO_Temp"=w24) -> (instance out=w25)
          append w25 to w5
        }
      }
    }
    next s1 = w5
  }
  $"PCB Temperatures" <- s1
  $Output <- w4
