vi "Pans charge.gviweb"   [G Web Development Software 22.3.0]
inputs:
  "Pans charge array": string[]
  "Intput": error
outputs:
  "Pans charge": T1[]
  "Output": error
  "minimum": f64[]
  "maximum": f64[]
types:
  T1 = cluster{"Timestamp": string, "Charge Left": string, "Charge Right": string}
uses:
  WebApp::Read_XML_array.gviweb
  WebApp::Maximum _PCB.gviweb
  WebApp::Minimum_PCB.gviweb
diagram:
  w1 = T1 {all zero or empty}  # Cluster Constant
  s1 = T1[] []  # shift register
  for (iteration -> i1) {
    w2 = each element of $"Pans charge array"
    call "Read_XML_array.gviweb"(Input XML=w2, Error in=$Intput) -> (Output XML array=w3, Error out=w4)
    case (i1) {
      frame 0 {
        for {
          w6 = each element of w3
          Match Pattern(regular expression="=\"", string=w6) -> (after substring=w7)
          Match Pattern(regular expression="\">", string=w7) -> (after substring=w8, before substring=w9)
          Match Pattern(regular expression="</", string=w8) -> (before substring=w10)
          String Subset(length (rest)=2, string=w9) -> w11
          String Subset(length (rest)=2, offset (0)=2, string=w9) -> w12
          String Subset(offset (0)=4, string=w9) -> w13
          Concatenate Strings(w11, ":", w12, ":", w13) -> w14
          Property Node(instance in=w1, "Timestamp"=w14, "Charge Left"=w10) -> (instance out=w15)
          append w15 to w5
        }
      }
      frame 1, Default {
        for {
          w16 = each element of w3
          Match Pattern(regular expression="=\"", string=w16) -> (after substring=w18)
          Match Pattern(regular expression="\">", string=w18) -> (after substring=w19)
          Match Pattern(regular expression="</", string=w19) -> (before substring=w20)
          Property Node(instance in=w1, "Charge Right"=w20) -> (instance out=w21)
          append w21 to w17
        }
        for {
          w22 = each element of s1
          w23 = each element of w17
          Property Node(instance in=w23) -> ("Charge Right"=w24)
          Property Node(instance in=w22, "Charge Right"=w24) -> (instance out=w25)
          append w25 to w5
        }
      }
    }
    next s1 = w5
  }
  call "Maximum _PCB.gviweb"(Temperature sensors=s1) -> (maximum=w26)
  $maximum <- w26
  call "Minimum_PCB.gviweb"(Temperature sensors=s1) -> (minimum left=w27)
  $minimum <- w27
  $"Pans charge" <- s1
  $Output <- w4
