vi "Pressure_in_pan.gviweb"   [G Web Development Software 22.3.0]
inputs:
  "Pressure_in_pan array": string[]
  "Intput": error
outputs:
  "Pressure_in_pan": T1[]
  "Output": error
  "maximum Pressure left": f64[]
  "minimum Pressure left": f64[]
types:
  T1 = cluster{"Timestamp": string, "Left_pressure_offset": string, "Left_pressure_offset_date": string, "Left_pressure_offset_time": string, "Left_pressure_phase": string, "P1_absolute": string, "P1_relative": string, "P3_I/O_pressure": string, "Pressure_in_pan_left": string}
uses:
  WebApp::Read_XML_array.gviweb
  WebApp::Maximum_Pressure_Left.gviweb
  WebApp::Minimum_Pressure_Left.gviweb
diagram:
  w1 = T1 {all zero or empty}  # Cluster Constant
  s1 = T1[] []  # shift register
  for (iteration -> i1) {
    w2 = each element of $"Pressure_in_pan array"
    call "Read_XML_array.gviweb"(Input XML=w2, Error in=$Intput) -> (Output XML array=w3, Error out=w4)
    case (i1) {
      frame 0 {
        for {
          w6 = each element of w3
          Match Pattern(regular expression="=\"", string=w6) -> (after substring=w7)
          Match Pattern(regular expression="\">", string=w7) -> (after substring=w8, before substring=w9)
          Match Pattern(regular expression="</", string=w8) -> (before substring=w10)
          String Subset(length (rest)=2, string=w9) -> w11
          String Subset(length (rest)=2, offset (0)=2, string=w9) -> w12
          String Subset(offset (0)=4, string=w9) -> w13
          Concatenate Strings(w11, ":", w12, ":", w13) -> w14
          Property Node(instance in=w1, "Timestamp"=w14, "Left_pressure_offset"=w10) -> (instance out=w15)
          append w15 to w5
        }
      }
      frame 1 {
        for {
          w16 = each element of w3
          Match Pattern(regular expression="=\"", string=w16) -> (after substring=w18)
          Match Pattern(regular expression="\">", string=w18) -> (after substring=w19)
          Match Pattern(regular expression="</", string=w19) -> (before substring=w20)
          Property Node(instance in=w1, "Left_pressure_offset_date"=w20) -> (instance out=w21)
          append w21 to w17
        }
        for {
          w22 = each element of s1
          w23 = each element of w17
          Property Node(instance in=w23) -> ("Left_pressure_offset_date"=w24)
          Property Node(instance in=w22, "Left_pressure_offset_date"=w24) -> (instance out=w25)
          append w25 to w5
        }
      }
      frame 2 {
        for {
          w26 = each element of w3
          Match Pattern(regular expression="=\"", string=w26) -> (after substring=w28)
          Match Pattern(regular expression="\">", string=w28) -> (after substring=w29)
          Match Pattern(regular expression="</", string=w29) -> (before substring=w30)
          Property Node(instance in=w1, "Left_pressure_offset_time"=w30) -> (instance out=w31)
          append w31 to w27
        }
        for {
          w32 = each element of s1
          w33 = each element of w27
          Property Node(instance in=w33) -> ("Left_pressure_offset_time"=w34)
          Property Node(instance in=w32, "Left_pressure_offset_time"=w34) -> (instance out=w35)
          append w35 to w5
        }
      }
      frame 3 {
        for {
          w36 = each element of w3
          Match Pattern(regular expression="=\"", string=w36) -> (after substring=w38)
          Match Pattern(regular expression="\">", string=w38) -> (after substring=w39)
          Match Pattern(regular expression="</", string=w39) -> (before substring=w40)
          Property Node(instance in=w1, "Left_pressure_phase"=w40) -> (instance out=w41)
          append w41 to w37
        }
        for {
          w42 = each element of s1
          w43 = each element of w37
          Property Node(instance in=w43) -> ("Left_pressure_phase"=w44)
          Property Node(instance in=w42, "Left_pressure_phase"=w44) -> (instance out=w45)
          append w45 to w5
        }
      }
      frame 4 {
        for {
          w46 = each element of w3
          Match Pattern(regular expression="=\"", string=w46) -> (after substring=w48)
          Match Pattern(regular expression="\">", string=w48) -> (after substring=w49)
          Match Pattern(regular expression="</", string=w49) -> (before substring=w50)
          Property Node(instance in=w1, "P1_absolute"=w50) -> (instance out=w51)
          append w51 to w47
        }
        for {
          w52 = each element of s1
          w53 = each element of w47
          Property Node(instance in=w53) -> ("P1_absolute"=w54)
          Property Node(instance in=w52, "P1_absolute"=w54) -> (instance out=w55)
          append w55 to w5
        }
      }
      frame 5 {
        for {
          w56 = each element of w3
          Match Pattern(regular expression="=\"", string=w56) -> (after substring=w58)
          Match Pattern(regular expression="\">", string=w58) -> (after substring=w59)
          Match Pattern(regular expression="</", string=w59) -> (before substring=w60)
          Property Node(instance in=w1, "P1_relative"=w60) -> (instance out=w61)
          append w61 to w57
        }
        for {
          w62 = each element of s1
          w63 = each element of w57
          Property Node(instance in=w63) -> ("P1_relative"=w64)
          Property Node(instance in=w62, "P1_relative"=w64) -> (instance out=w65)
          append w65 to w5
        }
      }
      frame 6 {
        for {
          w66 = each element of w3
          Match Pattern(regular expression="=\"", string=w66) -> (after substring=w68)
          Match Pattern(regular expression="\">", string=w68) -> (after substring=w69)
          Match Pattern(regular expression="</", string=w69) -> (before substring=w70)
          Property Node(instance in=w1, "P3_I/O_pressure"=w70) -> (instance out=w71)
          append w71 to w67
        }
        for {
          w72 = each element of s1
          w73 = each element of w67
          Property Node(instance in=w73) -> ("P3_I/O_pressure"=w74)
          Property Node(instance in=w72, "P3_I/O_pressure"=w74) -> (instance out=w75)
          append w75 to w5
        }
      }
      frame 7, Default {
        for {
          w76 = each element of w3
          Match Pattern(regular expression="=\"", string=w76) -> (after substring=w78)
          Match Pattern(regular expression="\">", string=w78) -> (after substring=w79)
          Match Pattern(regular expression="</", string=w79) -> (before substring=w80)
          Property Node(instance in=w1, "Pressure_in_pan_left"=w80) -> (instance out=w81)
          append w81 to w77
        }
        for {
          w82 = each element of s1
          w83 = each element of w77
          Property Node(instance in=w83) -> ("Pressure_in_pan_left"=w84)
          Property Node(instance in=w82, "Pressure_in_pan_left"=w84) -> (instance out=w85)
          append w85 to w5
        }
      }
    }
    next s1 = w5
  }
  $Pressure_in_pan <- s1
  call "Maximum_Pressure_Left.gviweb"(Left side pressure Pressure Left=s1) -> (maximum Pressure left=w86)
  $"maximum Pressure left" <- w86
  call "Minimum_Pressure_Left.gviweb"(Left side pressure Pressure Left=s1) -> (minimum Angles=w87)
  $"minimum Pressure left" <- w87
  $Output <- w4
