vi "Read_XML_Part.gviweb"   [G Web Development Software 22.3.0]
inputs:
  "Input XML": string
  "Start XML Part": string = "<Common_Information>"
  "End XML Part": string = "</Common_Information>"
  "Error in": error
outputs:
  "Output XML array": string[]
  "Error out": error
uses:
  NI::G Core::Strings::Trim Whitespace.gvi
diagram:
  s1 = string[] []  # shift register
  s2 = uninitialised  # shift register
  while (iteration -> i1) {
    case (i1) {
      frame 0 {
        w1 = $"Input XML"
      }
      frame 1, Default {
        w1 = s2
      }
    }
    call "Trim Whitespace.gvi"(String=w1) -> (Gekürzter String=w2)
    Match Pattern(regular expression=$"Start XML Part", string=w2) -> (after substring=w3)
    Match Pattern(regular expression=$"End XML Part", string=w3) -> (before substring=w4)
    Is Empty String Or Path(string/path=w4) -> w5
    case (w5) {
      frame False, Default {
        Insert Into Array(inArray=s1, new=w4) -> w6
        w7 = w3
        w8 = w5
      }
      frame True {
        w6 = s1
        w7 = ""
        w8 = w5
      }
    }
    next s1 = w6
    next s2 = w7
    stop if w8
  }
  $"Output XML array" <- s1
  $"Error out" <- $"Error in"
