vi "Read_XML_array.gviweb"   [G Web Development Software 22.3.0]
inputs:
  "Input XML": string
  "Error in": error
outputs:
  "Output XML array": string[]
  "Error out": error
uses:
  NI::G Core::Strings::Trim Whitespace.gvi
diagram:
  Match Pattern(regular expression="<Value", string=$"Input XML") -> (before substring=w1)
  call "Trim Whitespace.gvi"(string=w1) -> (trimmed string=w2)
  call "Trim Whitespace.gvi"(string=$"Input XML") -> (trimmed string=w3)
  s1 = string[] []  # shift register
  s2 = w3  # shift register
  while (iteration -> i1) {
    case (i1) {
      frame 0 {
        w4 = w3
      }
      frame 1, Default {
        w4 = s2
      }
    }
    call "Trim Whitespace.gvi"(String=w4) -> (Gekürzter String=w5)
    Match Pattern(regular expression="Timestamp", string=w5) -> (after substring=w6)
    call "Trim Whitespace.gvi"(String="Value") -> (Gekürzter String=w7)
    Match Pattern(regular expression=w7, string=w6) -> (before substring=w8)
    Is Empty String Or Path(string/path=w8) -> w9
    case (w9) {
      frame False, Default {
        Concatenate Strings(w2, w8) -> w13
        Insert Into Array(inArray=s1, new=w13) -> w10
        w11 = w6
        w12 = w9
      }
      frame True {
        w10 = s1
        w11 = ""
        w12 = w9
      }
    }
    next s1 = w10
    next s2 = w11
    stop if w12
  }
  $"Error out" <- $"Error in"
  $"Output XML array" <- s1
