vi "SSR Commands.gviweb"   [G Web Development Software 22.3.0]
inputs:
  "SSR Commands array": string[]
  "Intput": error
outputs:
  "SSR Commands": T1[]
  "Output": error
types:
  T1 = cluster{"Timestamp": string, "R101": string, "R102": string, "R103": string, "R104": string, "R105": string, "R106": string, "R107": string, "R108": string, "R109": string, "R110": string, "R111": string, "R112": string, "R113": string, "R114": string, "R115": string, "R116": string, "R117": string, "R118": string}
uses:
  WebApp::Read_XML_array.gviweb
  WebApp::SSR_State.gviweb
diagram:
  w1 = T1 {all zero or empty}  # Cluster Constant
  s1 = T1[] []  # shift register
  for (iteration -> i1) {
    w2 = each element of $"SSR Commands array"
    call "Read_XML_array.gviweb"(Input XML=w2, Error in=$Intput) -> (Output XML array=w3, Error out=w4)
    case (i1) {
      frame 0 {
        for {
          w6 = each element of w3
          Match Pattern(regular expression="=\"", string=w6) -> (after substring=w7)
          Match Pattern(regular expression="\">", string=w7) -> (after substring=w8, before substring=w9)
          Match Pattern(regular expression="</", string=w8) -> (before substring=w10)
          call "SSR_State.gviweb"(String input=w10) -> (Output=w11)
          String Subset(length (rest)=2, string=w9) -> w12
          String Subset(length (rest)=2, offset (0)=2, string=w9) -> w13
          String Subset(offset (0)=4, string=w9) -> w14
          Concatenate Strings(w12, ":", w13, ":", w14) -> w15
          Property Node(instance in=w1, "Timestamp"=w15, "R101"=w11) -> (instance out=w16)
          append w16 to w5
        }
      }
      frame 1 {
        for {
          w17 = each element of w3
          Match Pattern(regular expression="=\"", string=w17) -> (after substring=w19)
          Match Pattern(regular expression="\">", string=w19) -> (after substring=w20)
          Match Pattern(regular expression="</", string=w20) -> (before substring=w21)
          call "SSR_State.gviweb"(String input=w21) -> (Output=w22)
          Property Node(instance in=w1, "R102"=w22) -> (instance out=w23)
          append w23 to w18
        }
        for {
          w24 = each element of s1
          w25 = each element of w18
          Property Node(instance in=w25) -> ("R102"=w26)
          Property Node(instance in=w24, "R102"=w26) -> (instance out=w27)
          append w27 to w5
        }
      }
      frame 2 {
        for {
          w28 = each element of w3
          Match Pattern(regular expression="=\"", string=w28) -> (after substring=w30)
          Match Pattern(regular expression="\">", string=w30) -> (after substring=w31)
          Match Pattern(regular expression="</", string=w31) -> (before substring=w32)
          call "SSR_State.gviweb"(String input=w32) -> (Output=w33)
          Property Node(instance in=w1, "R103"=w33) -> (instance out=w34)
          append w34 to w29
        }
        for {
          w35 = each element of s1
          w36 = each element of w29
          Property Node(instance in=w36) -> ("R103"=w37)
          Property Node(instance in=w35, "R103"=w37) -> (instance out=w38)
          append w38 to w5
        }
      }
      frame 3 {
        for {
          w39 = each element of w3
          Match Pattern(regular expression="=\"", string=w39) -> (after substring=w41)
          Match Pattern(regular expression="\">", string=w41) -> (after substring=w42)
          Match Pattern(regular expression="</", string=w42) -> (before substring=w43)
          call "SSR_State.gviweb"(String input=w43) -> (Output=w44)
          Property Node(instance in=w1, "R104"=w44) -> (instance out=w45)
          append w45 to w40
        }
        for {
          w46 = each element of s1
          w47 = each element of w40
          Property Node(instance in=w47) -> ("R104"=w48)
          Property Node(instance in=w46, "R104"=w48) -> (instance out=w49)
          append w49 to w5
        }
      }
      frame 4 {
        for {
          w50 = each element of w3
          Match Pattern(regular expression="=\"", string=w50) -> (after substring=w52)
          Match Pattern(regular expression="\">", string=w52) -> (after substring=w53)
          Match Pattern(regular expression="</", string=w53) -> (before substring=w54)
          call "SSR_State.gviweb"(String input=w54) -> (Output=w55)
          Property Node(instance in=w1, "R105"=w55) -> (instance out=w56)
          append w56 to w51
        }
        for {
          w57 = each element of s1
          w58 = each element of w51
          Property Node(instance in=w58) -> ("R105"=w59)
          Property Node(instance in=w57, "R105"=w59) -> (instance out=w60)
          append w60 to w5
        }
      }
      frame 5 {
        for {
          w61 = each element of w3
          Match Pattern(regular expression="=\"", string=w61) -> (after substring=w63)
          Match Pattern(regular expression="\">", string=w63) -> (after substring=w64)
          Match Pattern(regular expression="</", string=w64) -> (before substring=w65)
          call "SSR_State.gviweb"(String input=w65) -> (Output=w66)
          Property Node(instance in=w1, "R106"=w66) -> (instance out=w67)
          append w67 to w62
        }
        for {
          w68 = each element of s1
          w69 = each element of w62
          Property Node(instance in=w69) -> ("R106"=w70)
          Property Node(instance in=w68, "R106"=w70) -> (instance out=w71)
          append w71 to w5
        }
      }
      frame 6 {
        for {
          w72 = each element of w3
          Match Pattern(regular expression="=\"", string=w72) -> (after substring=w74)
          Match Pattern(regular expression="\">", string=w74) -> (after substring=w75)
          Match Pattern(regular expression="</", string=w75) -> (before substring=w76)
          call "SSR_State.gviweb"(String input=w76) -> (Output=w77)
          Property Node(instance in=w1, "R107"=w77) -> (instance out=w78)
          append w78 to w73
        }
        for {
          w79 = each element of s1
          w80 = each element of w73
          Property Node(instance in=w80) -> ("R107"=w81)
          Property Node(instance in=w79, "R107"=w81) -> (instance out=w82)
          append w82 to w5
        }
      }
      frame 7 {
        for {
          w83 = each element of w3
          Match Pattern(regular expression="=\"", string=w83) -> (after substring=w85)
          Match Pattern(regular expression="\">", string=w85) -> (after substring=w86)
          Match Pattern(regular expression="</", string=w86) -> (before substring=w87)
          call "SSR_State.gviweb"(String input=w87) -> (Output=w88)
          Property Node(instance in=w1, "R108"=w88) -> (instance out=w89)
          append w89 to w84
        }
        for {
          w90 = each element of s1
          w91 = each element of w84
          Property Node(instance in=w91) -> ("R108"=w92)
          Property Node(instance in=w90, "R108"=w92) -> (instance out=w93)
          append w93 to w5
        }
      }
      frame 8 {
        for {
          w94 = each element of w3
          Match Pattern(regular expression="=\"", string=w94) -> (after substring=w96)
          Match Pattern(regular expression="\">", string=w96) -> (after substring=w97)
          Match Pattern(regular expression="</", string=w97) -> (before substring=w98)
          call "SSR_State.gviweb"(String input=w98) -> (Output=w99)
          Property Node(instance in=w1, "R109"=w99) -> (instance out=w100)
          append w100 to w95
        }
        for {
          w101 = each element of s1
          w102 = each element of w95
          Property Node(instance in=w102) -> ("R109"=w103)
          Property Node(instance in=w101, "R109"=w103) -> (instance out=w104)
          append w104 to w5
        }
      }
      frame 9 {
        for {
          w105 = each element of w3
          Match Pattern(regular expression="=\"", string=w105) -> (after substring=w107)
          Match Pattern(regular expression="\">", string=w107) -> (after substring=w108)
          Match Pattern(regular expression="</", string=w108) -> (before substring=w109)
          call "SSR_State.gviweb"(String input=w109) -> (Output=w110)
          Property Node(instance in=w1, "R110"=w110) -> (instance out=w111)
          append w111 to w106
        }
        for {
          w112 = each element of s1
          w113 = each element of w106
          Property Node(instance in=w113) -> ("R110"=w114)
          Property Node(instance in=w112, "R110"=w114) -> (instance out=w115)
          append w115 to w5
        }
      }
      frame 10 {
        for {
          w116 = each element of w3
          Match Pattern(regular expression="=\"", string=w116) -> (after substring=w118)
          Match Pattern(regular expression="\">", string=w118) -> (after substring=w119)
          Match Pattern(regular expression="</", string=w119) -> (before substring=w120)
          call "SSR_State.gviweb"(String input=w120) -> (Output=w121)
          Property Node(instance in=w1, "R111"=w121) -> (instance out=w122)
          append w122 to w117
        }
        for {
          w123 = each element of s1
          w124 = each element of w117
          Property Node(instance in=w124) -> ("R111"=w125)
          Property Node(instance in=w123, "R111"=w125) -> (instance out=w126)
          append w126 to w5
        }
      }
      frame 11 {
        for {
          w127 = each element of w3
          Match Pattern(regular expression="=\"", string=w127) -> (after substring=w129)
          Match Pattern(regular expression="\">", string=w129) -> (after substring=w130)
          Match Pattern(regular expression="</", string=w130) -> (before substring=w131)
          call "SSR_State.gviweb"(String input=w131) -> (Output=w132)
          Property Node(instance in=w1, "R112"=w132) -> (instance out=w133)
          append w133 to w128
        }
        for {
          w134 = each element of s1
          w135 = each element of w128
          Property Node(instance in=w135) -> ("R112"=w136)
          Property Node(instance in=w134, "R112"=w136) -> (instance out=w137)
          append w137 to w5
        }
      }
      frame 12 {
        for {
          w138 = each element of w3
          Match Pattern(regular expression="=\"", string=w138) -> (after substring=w140)
          Match Pattern(regular expression="\">", string=w140) -> (after substring=w141)
          Match Pattern(regular expression="</", string=w141) -> (before substring=w142)
          call "SSR_State.gviweb"(String input=w142) -> (Output=w143)
          Property Node(instance in=w1, "R113"=w143) -> (instance out=w144)
          append w144 to w139
        }
        for {
          w145 = each element of s1
          w146 = each element of w139
          Property Node(instance in=w146) -> ("R113"=w147)
          Property Node(instance in=w145, "R113"=w147) -> (instance out=w148)
          append w148 to w5
        }
      }
      frame 13 {
        for {
          w149 = each element of w3
          Match Pattern(regular expression="=\"", string=w149) -> (after substring=w151)
          Match Pattern(regular expression="\">", string=w151) -> (after substring=w152)
          Match Pattern(regular expression="</", string=w152) -> (before substring=w153)
          call "SSR_State.gviweb"(String input=w153) -> (Output=w154)
          Property Node(instance in=w1, "R114"=w154) -> (instance out=w155)
          append w155 to w150
        }
        for {
          w156 = each element of s1
          w157 = each element of w150
          Property Node(instance in=w157) -> ("R114"=w158)
          Property Node(instance in=w156, "R114"=w158) -> (instance out=w159)
          append w159 to w5
        }
      }
      frame 14 {
        for {
          w160 = each element of w3
          Match Pattern(regular expression="=\"", string=w160) -> (after substring=w162)
          Match Pattern(regular expression="\">", string=w162) -> (after substring=w163)
          Match Pattern(regular expression="</", string=w163) -> (before substring=w164)
          call "SSR_State.gviweb"(String input=w164) -> (Output=w165)
          Property Node(instance in=w1, "R115"=w165) -> (instance out=w166)
          append w166 to w161
        }
        for {
          w167 = each element of s1
          w168 = each element of w161
          Property Node(instance in=w168) -> ("R115"=w169)
          Property Node(instance in=w167, "R115"=w169) -> (instance out=w170)
          append w170 to w5
        }
      }
      frame 15 {
        for {
          w171 = each element of w3
          Match Pattern(regular expression="=\"", string=w171) -> (after substring=w173)
          Match Pattern(regular expression="\">", string=w173) -> (after substring=w174)
          Match Pattern(regular expression="</", string=w174) -> (before substring=w175)
          call "SSR_State.gviweb"(String input=w175) -> (Output=w176)
          Property Node(instance in=w1, "R116"=w176) -> (instance out=w177)
          append w177 to w172
        }
        for {
          w178 = each element of s1
          w179 = each element of w172
          Property Node(instance in=w179) -> ("R116"=w180)
          Property Node(instance in=w178, "R116"=w180) -> (instance out=w181)
          append w181 to w5
        }
      }
      frame 16 {
        for {
          w182 = each element of w3
          Match Pattern(regular expression="=\"", string=w182) -> (after substring=w184)
          Match Pattern(regular expression="\">", string=w184) -> (after substring=w185)
          Match Pattern(regular expression="</", string=w185) -> (before substring=w186)
          call "SSR_State.gviweb"(String input=w186) -> (Output=w187)
          Property Node(instance in=w1, "R117"=w187) -> (instance out=w188)
          append w188 to w183
        }
        for {
          w189 = each element of s1
          w190 = each element of w183
          Property Node(instance in=w190) -> ("R117"=w191)
          Property Node(instance in=w189, "R117"=w191) -> (instance out=w192)
          append w192 to w5
        }
      }
      frame 17, Default {
        for {
          w193 = each element of w3
          Match Pattern(regular expression="=\"", string=w193) -> (after substring=w195)
          Match Pattern(regular expression="\">", string=w195) -> (after substring=w196)
          Match Pattern(regular expression="</", string=w196) -> (before substring=w197)
          call "SSR_State.gviweb"(String input=w197) -> (Output=w198)
          Property Node(instance in=w1, "R118"=w198) -> (instance out=w199)
          append w199 to w194
        }
        for {
          w200 = each element of s1
          w201 = each element of w194
          Property Node(instance in=w201) -> ("R118"=w202)
          Property Node(instance in=w200, "R118"=w202) -> (instance out=w203)
          append w203 to w5
        }
      }
    }
    next s1 = w5
  }
  $"SSR Commands" <- s1
  $Output <- w4
