vi "Temp_Sensors_Displaying.gviweb"   [G Web Development Software 22.3.0]
inputs:
  "String": string = """B101

        <Value Timestamp="110406.229">21.256</Value>
        <Value Timestamp="110406.329">21.255</Value>
        <Value Timestamp="110406.429">21.255</Value>
        <Value Timestamp="110406.529">21.254</Value>
        <Value Timestamp="110406.629">21.253</Value>
        <Value Timestamp="110406.729">21.253</Value>
        <Value Timestamp="110406.829">21.253</Value>
        <Value Timestamp="110406.929">21.25</Value>
        <Value Timestamp="110407.029">21.256</Value>
        <Value Timestamp="110407.130">21.258</Value>
        <Value Timestamp="110407.229">21.254</Value>
        <Value Timestamp="110407.329">21.257</Value>
        <Value Timestamp="110407.429">21.26</Value>
        <Value Timestamp="110407.529">21.264</Value>
        <Value Timestamp="110407.629">21.263</Value>
        <Value Timestamp="110407.729">21.264</Value>
        <Value Timestamp="110407.829">21.266</Value>
        <Value Timestamp="110407.929">21.269</Value>
        <Value Timestamp="110408.029">21.266</Value>
        <Value Timestamp="110408.130">21.27</Value>
        <Value Timestamp="110408.229">21.275</Value>
        <Value Timestamp="110408.329">21.268</Value>
        <Value Timestamp="110408.429">21.275</Value>
        <Value Timestamp="110408.529">21.271</Value>
        <Value Timestamp="110408.629">21.273</Value>
        <Value Timestamp="110408.729">21.272</Value>
        <Value Timestamp="110408.829">21.27</Value>
        <Value Timestamp="110408.929">21.27</Value>
        <Val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
  "Intput": error
outputs:
  "output sensor": string
  "Output error": error
uses:
  NI::G Core::Strings::Trim Whitespace.gvi
diagram:
  $"Output error" <- $Intput
  # "B101", "B102", "B103", "B104", "B105", "B106", "B107", "B108", "B109", "B110", "B111", "B112", "B113", "B114", "B115", "B116", "B117", "B118", "B201", "B211", "B301", "B302", "B303", "B304", "B305", "B306", "B311", "B312", "B313", "B314", "B315", "B316"
  # "B101", "B102", "B103", "B104", "B105", "B106", "B201", "B301", "B302", "B303", "B304", "B305", "B306"
  # "B107", "B108", "B109", "B110", "B111", "B112", "B211", "B311", "B312", "B313", "B314", "B315", "B316"
  Match Pattern(regular expression="\n", string=$String) -> (before substring=w1)
  call "Trim Whitespace.gvi"(string=w1) -> (trimmed string=w2)
  $"output sensor" <- w2
