vi "Temperature sensors.gviweb"   [G Web Development Software 22.3.0]
inputs:
  "Temperature sensors array": string[]
  "Intput": error
outputs:
  "Temperature sensors": T1[]
  "Output": error
  "maximum left": f64[]
  "minimum left": f64[]
panel controls:
  "Temperature sensors Left": string[]
panel indicators:
  "Fühler Namen": string[]
types:
  T1 = cluster{"Timestamp": string, "B101": string, "B102": string, "B103": string, "B104": string, "B105": string, "B106": string, "B201": string, "B301": string, "B302": string, "B303": string, "B304": string, "B305": string, "B306": string}
uses:
  WebApp::Read_XML_array.gviweb
  WebApp::Temp_Sensors_Displaying.gviweb
  NI::G Core::Strings::Trim Whitespace.gvi
  WebApp::Maximum_Left.gviweb
  WebApp::Minimum_Left.gviweb
diagram:
  w1 = T1 {all zero or empty}  # Cluster Constant
  s1 = T1[] []  # shift register
  for {
    w2 = each element of $"Temperature sensors array"
    call "Read_XML_array.gviweb"(Input XML=w2, Error in=$Intput) -> (Output XML array=w4, Error out=w5)
    call "Temp_Sensors_Displaying.gviweb"(String=w2, Intput=w5) -> (output sensor=w6, Output error=w7)
    call "Trim Whitespace.gvi"(string=w6) -> (trimmed string=w8)
    case (w8) {
      frame "B101" {
        for {
          w10 = each element of w4
          Match Pattern(regular expression="=\"", string=w10) -> (after substring=w11)
          Match Pattern(regular expression="\">", string=w11) -> (after substring=w12, before substring=w13)
          Match Pattern(regular expression="</", string=w12) -> (before substring=w14)
          String Subset(length (rest)=2, string=w13) -> w15
          String Subset(length (rest)=2, offset (0)=2, string=w13) -> w16
          String Subset(offset (0)=4, string=w13) -> w17
          Concatenate Strings(w15, ":", w16, ":", w17) -> w18
          Property Node(instance in=w1, "Timestamp"=w18, "B101"=w14) -> (instance out=w19)
          append w19 to w9
        }
      }
      frame "B102" {
        for {
          w20 = each element of w4
          Match Pattern(regular expression="=\"", string=w20) -> (after substring=w22)
          Match Pattern(regular expression="\">", string=w22) -> (after substring=w23)
          Match Pattern(regular expression="</", string=w23) -> (before substring=w24)
          Property Node(instance in=w1, "B102"=w24) -> (instance out=w25)
          append w25 to w21
        }
        for {
          w26 = each element of s1
          w27 = each element of w21
          Property Node(instance in=w27) -> ("B102"=w28)
          Property Node(instance in=w26, "B102"=w28) -> (instance out=w29)
          append w29 to w9
        }
      }
      frame "B103" {
        for {
          w30 = each element of w4
          Match Pattern(regular expression="=\"", string=w30) -> (after substring=w32)
          Match Pattern(regular expression="\">", string=w32) -> (after substring=w33)
          Match Pattern(regular expression="</", string=w33) -> (before substring=w34)
          Property Node(instance in=w1, "B103"=w34) -> (instance out=w35)
          append w35 to w31
        }
        for {
          w36 = each element of s1
          w37 = each element of w31
          Property Node(instance in=w37) -> ("B103"=w38)
          Property Node(instance in=w36, "B103"=w38) -> (instance out=w39)
          append w39 to w9
        }
      }
      frame "B104" {
        for {
          w40 = each element of w4
          Match Pattern(regular expression="=\"", string=w40) -> (after substring=w42)
          Match Pattern(regular expression="\">", string=w42) -> (after substring=w43)
          Match Pattern(regular expression="</", string=w43) -> (before substring=w44)
          Property Node(instance in=w1, "B104"=w44) -> (instance out=w45)
          append w45 to w41
        }
        for {
          w46 = each element of s1
          w47 = each element of w41
          Property Node(instance in=w47) -> ("B104"=w48)
          Property Node(instance in=w46, "B104"=w48) -> (instance out=w49)
          append w49 to w9
        }
      }
      frame "B105" {
        for {
          w50 = each element of w4
          Match Pattern(regular expression="=\"", string=w50) -> (after substring=w52)
          Match Pattern(regular expression="\">", string=w52) -> (after substring=w53)
          Match Pattern(regular expression="</", string=w53) -> (before substring=w54)
          Property Node(instance in=w1, "B105"=w54) -> (instance out=w55)
          append w55 to w51
        }
        for {
          w56 = each element of s1
          w57 = each element of w51
          Property Node(instance in=w57) -> ("B105"=w58)
          Property Node(instance in=w56, "B105"=w58) -> (instance out=w59)
          append w59 to w9
        }
      }
      frame "B106" {
        for {
          w60 = each element of w4
          Match Pattern(regular expression="=\"", string=w60) -> (after substring=w62)
          Match Pattern(regular expression="\">", string=w62) -> (after substring=w63)
          Match Pattern(regular expression="</", string=w63) -> (before substring=w64)
          Property Node(instance in=w1, "B106"=w64) -> (instance out=w65)
          append w65 to w61
        }
        for {
          w66 = each element of s1
          w67 = each element of w61
          Property Node(instance in=w67) -> ("B106"=w68)
          Property Node(instance in=w66, "B106"=w68) -> (instance out=w69)
          append w69 to w9
        }
      }
      frame "B201" {
        for {
          w70 = each element of w4
          Match Pattern(regular expression="=\"", string=w70) -> (after substring=w72)
          Match Pattern(regular expression="\">", string=w72) -> (after substring=w73)
          Match Pattern(regular expression="</", string=w73) -> (before substring=w74)
          Property Node(instance in=w1, "B201"=w74) -> (instance out=w75)
          append w75 to w71
        }
        for {
          w76 = each element of s1
          w77 = each element of w71
          Property Node(instance in=w77) -> ("B201"=w78)
          Property Node(instance in=w76, "B201"=w78) -> (instance out=w79)
          append w79 to w9
        }
      }
      frame "B301" {
        for {
          w80 = each element of w4
          Match Pattern(regular expression="=\"", string=w80) -> (after substring=w82)
          Match Pattern(regular expression="\">", string=w82) -> (after substring=w83)
          Match Pattern(regular expression="</", string=w83) -> (before substring=w84)
          Property Node(instance in=w1, "B301"=w84) -> (instance out=w85)
          append w85 to w81
        }
        for {
          w86 = each element of s1
          w87 = each element of w81
          Property Node(instance in=w87) -> ("B301"=w88)
          Property Node(instance in=w86, "B301"=w88) -> (instance out=w89)
          append w89 to w9
        }
      }
      frame "B302" {
        for {
          w90 = each element of w4
          Match Pattern(regular expression="=\"", string=w90) -> (after substring=w92)
          Match Pattern(regular expression="\">", string=w92) -> (after substring=w93)
          Match Pattern(regular expression="</", string=w93) -> (before substring=w94)
          Property Node(instance in=w1, "B302"=w94) -> (instance out=w95)
          append w95 to w91
        }
        for {
          w96 = each element of s1
          w97 = each element of w91
          Property Node(instance in=w97) -> ("B302"=w98)
          Property Node(instance in=w96, "B302"=w98) -> (instance out=w99)
          append w99 to w9
        }
      }
      frame "B303" {
        for {
          w100 = each element of w4
          Match Pattern(regular expression="=\"", string=w100) -> (after substring=w102)
          Match Pattern(regular expression="\">", string=w102) -> (after substring=w103)
          Match Pattern(regular expression="</", string=w103) -> (before substring=w104)
          Property Node(instance in=w1, "B303"=w104) -> (instance out=w105)
          append w105 to w101
        }
        for {
          w106 = each element of s1
          w107 = each element of w101
          Property Node(instance in=w107) -> ("B303"=w108)
          Property Node(instance in=w106, "B303"=w108) -> (instance out=w109)
          append w109 to w9
        }
      }
      frame "B304" {
        for {
          w110 = each element of w4
          Match Pattern(regular expression="=\"", string=w110) -> (after substring=w112)
          Match Pattern(regular expression="\">", string=w112) -> (after substring=w113)
          Match Pattern(regular expression="</", string=w113) -> (before substring=w114)
          Property Node(instance in=w1, "B304"=w114) -> (instance out=w115)
          append w115 to w111
        }
        for {
          w116 = each element of s1
          w117 = each element of w111
          Property Node(instance in=w117) -> ("B304"=w118)
          Property Node(instance in=w116, "B304"=w118) -> (instance out=w119)
          append w119 to w9
        }
      }
      frame "B305" {
        for {
          w120 = each element of w4
          Match Pattern(regular expression="=\"", string=w120) -> (after substring=w122)
          Match Pattern(regular expression="\">", string=w122) -> (after substring=w123)
          Match Pattern(regular expression="</", string=w123) -> (before substring=w124)
          Property Node(instance in=w1, "B305"=w124) -> (instance out=w125)
          append w125 to w121
        }
        for {
          w126 = each element of s1
          w127 = each element of w121
          Property Node(instance in=w127) -> ("B305"=w128)
          Property Node(instance in=w126, "B305"=w128) -> (instance out=w129)
          append w129 to w9
        }
      }
      frame "B306", Default {
        for {
          w130 = each element of w4
          Match Pattern(regular expression="=\"", string=w130) -> (after substring=w132)
          Match Pattern(regular expression="\">", string=w132) -> (after substring=w133)
          Match Pattern(regular expression="</", string=w133) -> (before substring=w134)
          Property Node(instance in=w1, "B306"=w134) -> (instance out=w135)
          append w135 to w131
        }
        for {
          w136 = each element of s1
          w137 = each element of w131
          Property Node(instance in=w137) -> ("B306"=w138)
          Property Node(instance in=w136, "B306"=w138) -> (instance out=w139)
          append w139 to w9
        }
      }
    }
    append w8 to w3
    next s1 = w9
  }
  call "Maximum_Left.gviweb"(Temperature sensors=s1) -> (maximum left=w140)
  $"maximum left" <- w140
  $"Temperature sensors" <- s1
  call "Minimum_Left.gviweb"(Temperature sensors=s1) -> (maximum left=w141)
  # "B101", "B102", "B103", "B104", "B105", "B106", "B201", "B301", "B302", "B303", "B304", "B305", "B306"
  $"minimum left" <- w141
  $"Fühler Namen" <- w3
  $Output <- w7
