vi "Temperature sensors_Right.gviweb"   [G Web Development Software 22.3.0]
inputs:
  "Temperature sensors array": string[]
  "Intput": error
outputs:
  "Temperature sensors": T1[]
  "Output": error
  "maximum right": f64[]
  "minimum right": f64[]
types:
  T1 = cluster{"Timestamp": string, "B101": string, "B102": string, "B103": string, "B104": string, "B105": string, "B106": string, "B201": string, "B301": string, "B302": string, "B303": string, "B304": string, "B305": string, "B306": string}
  T2 = cluster{"Timestamp": string, "B107": string, "B108": string, "B109": string, "B110": string, "B111": string, "B112": string, "B211": string, "B311": string, "B312": string, "B313": string, "B314": string, "B315": string, "B316": string}
uses:
  WebApp::Read_XML_array.gviweb
  WebApp::Temp_Sensors_Displaying.gviweb
  WebApp::Maximum_Temp_Right.gviweb
  WebApp::Minimum_Temp_Right.gviweb
diagram:
  w1 = T2 {all zero or empty}  # Cluster Constant
  # "B107", "B108", "B109", "B110", "B111", "B112", "B211", "B311", "B312", "B313", "B314", "B315", "B316"
  s1 = T2[] []  # shift register
  for {
    w2 = each element of $"Temperature sensors array"
    call "Read_XML_array.gviweb"(Input XML=w2, Error in=$Intput) -> (Output XML array=w3, Error out=w4)
    call "Temp_Sensors_Displaying.gviweb"(String=w2, Intput=w4) -> (output sensor=w5, Output error=w6)
    case (w5) {
      frame "B107" {
        for {
          w8 = each element of w3
          Match Pattern(regular expression="=\"", string=w8) -> (after substring=w9)
          Match Pattern(regular expression="\">", string=w9) -> (after substring=w10, before substring=w11)
          Match Pattern(regular expression="</", string=w10) -> (before substring=w12)
          String Subset(length (rest)=2, string=w11) -> w13
          String Subset(length (rest)=2, offset (0)=2, string=w11) -> w14
          String Subset(offset (0)=4, string=w11) -> w15
          Concatenate Strings(w13, ":", w14, ":", w15) -> w16
          Property Node(instance in=w1, "Timestamp"=w16, "B107"=w12) -> (instance out=w17)
          append w17 to w7
        }
      }
      frame "B108" {
        for {
          w18 = each element of w3
          Match Pattern(regular expression="=\"", string=w18) -> (after substring=w20)
          Match Pattern(regular expression="\">", string=w20) -> (after substring=w21)
          Match Pattern(regular expression="</", string=w21) -> (before substring=w22)
          Property Node(instance in=w1, "B108"=w22) -> (instance out=w23)
          append w23 to w19
        }
        for {
          w24 = each element of s1
          w25 = each element of w19
          Property Node(instance in=w25) -> ("B108"=w26)
          Property Node(instance in=w24, "B108"=w26) -> (instance out=w27)
          append w27 to w7
        }
      }
      frame "B109" {
        for {
          w28 = each element of w3
          Match Pattern(regular expression="=\"", string=w28) -> (after substring=w30)
          Match Pattern(regular expression="\">", string=w30) -> (after substring=w31)
          Match Pattern(regular expression="</", string=w31) -> (before substring=w32)
          Property Node(instance in=w1, "B109"=w32) -> (instance out=w33)
          append w33 to w29
        }
        for {
          w34 = each element of s1
          w35 = each element of w29
          Property Node(instance in=w35) -> ("B109"=w36)
          Property Node(instance in=w34, "B109"=w36) -> (instance out=w37)
          append w37 to w7
        }
      }
      frame "B110" {
        for {
          w38 = each element of w3
          Match Pattern(regular expression="=\"", string=w38) -> (after substring=w40)
          Match Pattern(regular expression="\">", string=w40) -> (after substring=w41)
          Match Pattern(regular expression="</", string=w41) -> (before substring=w42)
          Property Node(instance in=w1, "B110"=w42) -> (instance out=w43)
          append w43 to w39
        }
        for {
          w44 = each element of s1
          w45 = each element of w39
          Property Node(instance in=w45) -> ("B110"=w46)
          Property Node(instance in=w44, "B110"=w46) -> (instance out=w47)
          append w47 to w7
        }
      }
      frame "B111" {
        for {
          w48 = each element of w3
          Match Pattern(regular expression="=\"", string=w48) -> (after substring=w50)
          Match Pattern(regular expression="\">", string=w50) -> (after substring=w51)
          Match Pattern(regular expression="</", string=w51) -> (before substring=w52)
          Property Node(instance in=w1, "B111"=w52) -> (instance out=w53)
          append w53 to w49
        }
        for {
          w54 = each element of s1
          w55 = each element of w49
          Property Node(instance in=w55) -> ("B111"=w56)
          Property Node(instance in=w54, "B111"=w56) -> (instance out=w57)
          append w57 to w7
        }
      }
      frame "B112" {
        for {
          w58 = each element of w3
          Match Pattern(regular expression="=\"", string=w58) -> (after substring=w60)
          Match Pattern(regular expression="\">", string=w60) -> (after substring=w61)
          Match Pattern(regular expression="</", string=w61) -> (before substring=w62)
          Property Node(instance in=w1, "B112"=w62) -> (instance out=w63)
          append w63 to w59
        }
        for {
          w64 = each element of s1
          w65 = each element of w59
          Property Node(instance in=w65) -> ("B112"=w66)
          Property Node(instance in=w64, "B112"=w66) -> (instance out=w67)
          append w67 to w7
        }
      }
      frame "B211" {
        for {
          w68 = each element of w3
          Match Pattern(regular expression="=\"", string=w68) -> (after substring=w70)
          Match Pattern(regular expression="\">", string=w70) -> (after substring=w71)
          Match Pattern(regular expression="</", string=w71) -> (before substring=w72)
          Property Node(instance in=w1, "B211"=w72) -> (instance out=w73)
          append w73 to w69
        }
        for {
          w74 = each element of s1
          w75 = each element of w69
          Property Node(instance in=w75) -> ("B211"=w76)
          Property Node(instance in=w74, "B211"=w76) -> (instance out=w77)
          append w77 to w7
        }
      }
      frame "B311" {
        for {
          w78 = each element of w3
          Match Pattern(regular expression="=\"", string=w78) -> (after substring=w80)
          Match Pattern(regular expression="\">", string=w80) -> (after substring=w81)
          Match Pattern(regular expression="</", string=w81) -> (before substring=w82)
          Property Node(instance in=w1, "B311"=w82) -> (instance out=w83)
          append w83 to w79
        }
        for {
          w84 = each element of s1
          w85 = each element of w79
          Property Node(instance in=w85) -> ("B311"=w86)
          Property Node(instance in=w84, "B311"=w86) -> (instance out=w87)
          append w87 to w7
        }
      }
      frame "B312" {
        for {
          w88 = each element of w3
          Match Pattern(regular expression="=\"", string=w88) -> (after substring=w90)
          Match Pattern(regular expression="\">", string=w90) -> (after substring=w91)
          Match Pattern(regular expression="</", string=w91) -> (before substring=w92)
          Property Node(instance in=w1, "B312"=w92) -> (instance out=w93)
          append w93 to w89
        }
        for {
          w94 = each element of s1
          w95 = each element of w89
          Property Node(instance in=w95) -> ("B312"=w96)
          Property Node(instance in=w94, "B312"=w96) -> (instance out=w97)
          append w97 to w7
        }
      }
      frame "B313" {
        for {
          w98 = each element of w3
          Match Pattern(regular expression="=\"", string=w98) -> (after substring=w100)
          Match Pattern(regular expression="\">", string=w100) -> (after substring=w101)
          Match Pattern(regular expression="</", string=w101) -> (before substring=w102)
          Property Node(instance in=w1, "B313"=w102) -> (instance out=w103)
          append w103 to w99
        }
        for {
          w104 = each element of s1
          w105 = each element of w99
          Property Node(instance in=w105) -> ("B313"=w106)
          Property Node(instance in=w104, "B313"=w106) -> (instance out=w107)
          append w107 to w7
        }
      }
      frame "B314" {
        for {
          w108 = each element of w3
          Match Pattern(regular expression="=\"", string=w108) -> (after substring=w110)
          Match Pattern(regular expression="\">", string=w110) -> (after substring=w111)
          Match Pattern(regular expression="</", string=w111) -> (before substring=w112)
          Property Node(instance in=w1, "B314"=w112) -> (instance out=w113)
          append w113 to w109
        }
        for {
          w114 = each element of s1
          w115 = each element of w109
          Property Node(instance in=w115) -> ("B314"=w116)
          Property Node(instance in=w114, "B314"=w116) -> (instance out=w117)
          append w117 to w7
        }
      }
      frame "B315" {
        for {
          w118 = each element of w3
          Match Pattern(regular expression="=\"", string=w118) -> (after substring=w120)
          Match Pattern(regular expression="\">", string=w120) -> (after substring=w121)
          Match Pattern(regular expression="</", string=w121) -> (before substring=w122)
          Property Node(instance in=w1, "B315"=w122) -> (instance out=w123)
          append w123 to w119
        }
        for {
          w124 = each element of s1
          w125 = each element of w119
          Property Node(instance in=w125) -> ("B315"=w126)
          Property Node(instance in=w124, "B315"=w126) -> (instance out=w127)
          append w127 to w7
        }
      }
      frame "B316", Default {
        for {
          w128 = each element of w3
          Match Pattern(regular expression="=\"", string=w128) -> (after substring=w130)
          Match Pattern(regular expression="\">", string=w130) -> (after substring=w131)
          Match Pattern(regular expression="</", string=w131) -> (before substring=w132)
          Property Node(instance in=w1, "B316"=w132) -> (instance out=w133)
          append w133 to w129
        }
        for {
          w134 = each element of s1
          w135 = each element of w129
          Property Node(instance in=w135) -> ("B316"=w136)
          Property Node(instance in=w134, "B316"=w136) -> (instance out=w137)
          append w137 to w7
        }
      }
    }
    next s1 = w7
  }
  $"Temperature sensors" <- s1
  call "Maximum_Temp_Right.gviweb"(Temperature sensors=s1) -> (maximum right=w138)
  $"maximum right" <- w138
  call "Minimum_Temp_Right.gviweb"(Temperature sensors=s1) -> (minimum right=w139)
  $"minimum right" <- w139
  $Output <- w6
