vi "Valves.gviweb"   [G Web Development Software 22.3.0]
inputs:
  "Valves array": string[]
  "Intput": error
outputs:
  "Valves": T1[]
  "Output": error
types:
  T1 = cluster{"Timestamp": string, "Right AZ Valve command request": string, "Y1": string, "Y2": string, "Y3": string, "Y4": string, "Y4 close": string, "Y4 open": string, "Y5": string, "Y5 close": string, "Y5 open": string}
uses:
  WebApp::Read_XML_array.gviweb
  WebApp::Switch_State.gviweb
diagram:
  w1 = T1 {all zero or empty}  # Cluster Constant
  s1 = T1[] []  # shift register
  for (iteration -> i1) {
    w2 = each element of $"Valves array"
    call "Read_XML_array.gviweb"(Input XML=w2, Error in=$Intput) -> (Output XML array=w3, Error out=w4)
    case (i1) {
      frame 0 {
        for {
          w6 = each element of w3
          Match Pattern(regular expression="=\"", string=w6) -> (after substring=w7)
          Match Pattern(regular expression="\">", string=w7) -> (after substring=w8, before substring=w9)
          String Subset(length (rest)=2, string=w9) -> w10
          String Subset(length (rest)=2, offset (0)=2, string=w9) -> w11
          String Subset(offset (0)=4, string=w9) -> w12
          Concatenate Strings(w10, ":", w11, ":", w12) -> w13
          Match Pattern(regular expression="</", string=w8) -> (before substring=w14)
          call "Switch_State.gviweb"(String input=w14) -> (Output=w15)
          Property Node(instance in=w1, "Timestamp"=w13, "Right AZ Valve command request"=w15) -> (instance out=w16)
          append w16 to w5
        }
      }
      frame 1 {
        for {
          w17 = each element of w3
          Match Pattern(regular expression="=\"", string=w17) -> (after substring=w19)
          Match Pattern(regular expression="\">", string=w19) -> (after substring=w20)
          Match Pattern(regular expression="</", string=w20) -> (before substring=w21)
          call "Switch_State.gviweb"(String input=w21) -> (Output=w22)
          Property Node(instance in=w1, "Y1"=w22) -> (instance out=w23)
          append w23 to w18
        }
        for {
          w24 = each element of s1
          w25 = each element of w18
          Property Node(instance in=w25) -> ("Y1"=w26)
          Property Node(instance in=w24, "Y1"=w26) -> (instance out=w27)
          append w27 to w5
        }
      }
      frame 2 {
        for {
          w28 = each element of w3
          Match Pattern(regular expression="=\"", string=w28) -> (after substring=w30)
          Match Pattern(regular expression="\">", string=w30) -> (after substring=w31)
          Match Pattern(regular expression="</", string=w31) -> (before substring=w32)
          call "Switch_State.gviweb"(String input=w32) -> (Output=w33)
          Property Node(instance in=w1, "Y2"=w33) -> (instance out=w34)
          append w34 to w29
        }
        for {
          w35 = each element of s1
          w36 = each element of w29
          Property Node(instance in=w36) -> ("Y2"=w37)
          Property Node(instance in=w35, "Y2"=w37) -> (instance out=w38)
          append w38 to w5
        }
      }
      frame 3 {
        for {
          w39 = each element of w3
          Match Pattern(regular expression="=\"", string=w39) -> (after substring=w41)
          Match Pattern(regular expression="\">", string=w41) -> (after substring=w42)
          Match Pattern(regular expression="</", string=w42) -> (before substring=w43)
          call "Switch_State.gviweb"(String input=w43) -> (Output=w44)
          Property Node(instance in=w1, "Y3"=w44) -> (instance out=w45)
          append w45 to w40
        }
        for {
          w46 = each element of s1
          w47 = each element of w40
          Property Node(instance in=w47) -> ("Y3"=w48)
          Property Node(instance in=w46, "Y3"=w48) -> (instance out=w49)
          append w49 to w5
        }
      }
      frame 4 {
        for {
          w50 = each element of w3
          Match Pattern(regular expression="=\"", string=w50) -> (after substring=w52)
          Match Pattern(regular expression="\">", string=w52) -> (after substring=w53)
          Match Pattern(regular expression="</", string=w53) -> (before substring=w54)
          Property Node(instance in=w1, "Y4"=w54) -> (instance out=w55)
          append w55 to w51
        }
        for {
          w56 = each element of s1
          w57 = each element of w51
          Property Node(instance in=w57) -> ("Y4"=w58)
          Property Node(instance in=w56, "Y4"=w58) -> (instance out=w59)
          append w59 to w5
        }
      }
      frame 5 {
        for {
          w60 = each element of w3
          Match Pattern(regular expression="=\"", string=w60) -> (after substring=w62)
          Match Pattern(regular expression="\">", string=w62) -> (after substring=w63)
          Match Pattern(regular expression="</", string=w63) -> (before substring=w64)
          Property Node(instance in=w1, "Y4 close"=w64) -> (instance out=w65)
          append w65 to w61
        }
        for {
          w66 = each element of s1
          w67 = each element of w61
          Property Node(instance in=w67) -> ("Y4 close"=w68)
          Property Node(instance in=w66, "Y4 close"=w68) -> (instance out=w69)
          append w69 to w5
        }
      }
      frame 6 {
        for {
          w70 = each element of w3
          Match Pattern(regular expression="=\"", string=w70) -> (after substring=w72)
          Match Pattern(regular expression="\">", string=w72) -> (after substring=w73)
          Match Pattern(regular expression="</", string=w73) -> (before substring=w74)
          Property Node(instance in=w1, "Y4 open"=w74) -> (instance out=w75)
          append w75 to w71
        }
        for {
          w76 = each element of s1
          w77 = each element of w71
          Property Node(instance in=w77) -> ("Y4 open"=w78)
          Property Node(instance in=w76, "Y4 open"=w78) -> (instance out=w79)
          append w79 to w5
        }
      }
      frame 7 {
        for {
          w80 = each element of w3
          Match Pattern(regular expression="=\"", string=w80) -> (after substring=w82)
          Match Pattern(regular expression="\">", string=w82) -> (after substring=w83)
          Match Pattern(regular expression="</", string=w83) -> (before substring=w84)
          Property Node(instance in=w1, "Y5"=w84) -> (instance out=w85)
          append w85 to w81
        }
        for {
          w86 = each element of s1
          w87 = each element of w81
          Property Node(instance in=w87) -> ("Y5"=w88)
          Property Node(instance in=w86, "Y5"=w88) -> (instance out=w89)
          append w89 to w5
        }
      }
      frame 8 {
        for {
          w90 = each element of w3
          Match Pattern(regular expression="=\"", string=w90) -> (after substring=w92)
          Match Pattern(regular expression="\">", string=w92) -> (after substring=w93)
          Match Pattern(regular expression="</", string=w93) -> (before substring=w94)
          Property Node(instance in=w1, "Y5 close"=w94) -> (instance out=w95)
          append w95 to w91
        }
        for {
          w96 = each element of s1
          w97 = each element of w91
          Property Node(instance in=w97) -> ("Y5 close"=w98)
          Property Node(instance in=w96, "Y5 close"=w98) -> (instance out=w99)
          append w99 to w5
        }
      }
      frame 9, Default {
        for {
          w100 = each element of w3
          Match Pattern(regular expression="=\"", string=w100) -> (after substring=w102)
          Match Pattern(regular expression="\">", string=w102) -> (after substring=w103)
          Match Pattern(regular expression="</", string=w103) -> (before substring=w104)
          Property Node(instance in=w1, "Y5 open"=w104) -> (instance out=w105)
          append w105 to w101
        }
        for {
          w106 = each element of s1
          w107 = each element of w101
          Property Node(instance in=w107) -> ("Y5 open"=w108)
          Property Node(instance in=w106, "Y5 open"=w108) -> (instance out=w109)
          append w109 to w5
        }
      }
    }
    next s1 = w5
  }
  $Valves <- s1
  $Output <- w4
