vi "index.gviweb"   [G Web Development Software 22.3.0]
# Press “Analyse” and select a service report xml file
panel controls:
  "Analyse": bool  # Press the button “Analyse” and select a service report xml file.
  "Page 1": i32
  "error graph": bool
  "Left Pan": i32
  "Explanations": bool
  "Left Pan_2": i32
panel indicators:
  "Specifications:": T1[]
  "URL-Grafik": string
  "SSR Commands": T2[]
  "SSR Commands_2": T3[]
  "PCB Temperature": T4[]
  "Left side pressure data": T5[]
  "Right side pressure data": T6[]
  "Microswitch": T7[]
  "Valves": T8[]
  "Motors": T9[]
  "Temperature sensors_Left": T10[]
  "Temperature sensors_right": T11[]
  "maximum left": f64[]
  "minimum left": f64[]
  "maximum right": f64[]
  "minimum right": f64[]
  "maximum": f64[]
  "minimum": f64[]
  "Angles": T12[]
  "maximum Angles": f64[]
  "minimum Angles": f64[]
  "Curve singel": cluster{"Element 1": f64[], "Element 2": f64[]}[]
  "Curve singel_right": cluster{"Element 1": f64[], "Element 2": f64[]}[]
  "File content:": string
  "maximum Pressure left": f64[]
  "minimum Pressure left": f64[]
  "maximum Pressure right": f64[]
  "minimum Pressure right": f64[]
  "Curve temp_PCB": cluster{"Element 1": f64[], "Element 2": f64[]}[]
  "Curve singel_right_2": cluster{"Element 1": f64[], "Element 2": f64[]}[]
  "Curve Pressure": cluster{"Element 1": f64[], "Element 2": f64[]}[]
  "Curve angles": cluster{"Element 1": f64[], "Element 2": f64[]}[]
types:
  T1 = cluster{"Information": string, "Details": string}
  T2 = cluster{"Timestamp": string, "R101": string, "R102": string, "R103": string, "R104": string, "R105": string, "R106": string, "R107": string, "R108": string, "R109": string, "R110": string, "R111": string, "R112": string, "R113": string, "R114": string, "R115": string, "R116": string, "R117": string, "R118": string}
  T3 = cluster{"Timestamp": string, "Charge Left": string, "Charge Right": string}
  T4 = cluster{"Timestamp": string, "CPU temperature": string, "IO temperature": string}
  T5 = cluster{"Timestamp": string, "Pressure_offset/ Left": string, "Pressure_offset_date/ Left": string, "Pressure_offset_time/ Left": string, "Pressure_phase/ Left": string, "P1_absolute": string, "P1_relative": string, "P3_I/O_pressure": string, "Pressure_in_pan/ Left": string}
  T6 = cluster{"Timestamp": string, "P2_absolute": string, "P2_relative": string, "Pressure_in_pan/ Right": string, "Right_pressure_offset": string, "Right_pressure_offset_date": string, "Right_pressure_offset_time": string, "Pressure_phase/ Right": string}
  T7 = cluster{"Timestamp": string, "S11": string, "S111": string, "S12": string, "S13": string, "Safety Chain Voltage": string}
  T8 = cluster{"Timestamp": string, "Right AZ Valve command request": string, "Y1": string, "Y2": string, "Y3": string, "Y4": string, "Y4 Close": string, "Y4 open": string, "Y5": string, "Y5 close": string, "Y5 open": string}
  T9 = cluster{"Timestamp": string, "Left Rahrbach locking": string, "Left Rahrbach unlocking": string, "M10(Cooling fan motor SSR)": string, "M2(Left Pan or lid)": string, "M4(Left Lid)": string, "M4-S1(Left Drain closed)": string, "M4-S2-S6(Left Lid locked switch)": string, "M4-S3(Left Drain open switch state)": string, "M6 (Right pan or lid)": string, "M8 (Right lid locked)": string, "M8-S1(Right drain closed)": string, "M8-S2-S6(Right lid locked switch state)": string, "M8-S3(Right drain open switch state)": string, "Right Rahrbach lock.": string, "Right Rahrbach unlock.": string}
  T10 = cluster{"Timestamp": string, "B101": string, "B102": string, "B103": string, "B104": string, "B105": string, "B106": string, "B201": string, "B301": string, "B302": string, "B303": string, "B304": string, "B305": string, "B306": string}
  T11 = cluster{"Timestamp": string, "B107": string, "B108": string, "B109": string, "B110": string, "B111": string, "B112": string, "B211": string, "B311": string, "B312": string, "B313": string, "B314": string, "B315": string, "B316": string}
  T12 = cluster{"Timestamp": string, "pt1": string, "pt1[ang]_lid": string, "pt1[ang]_pan": string, "pt2": string, "pt2[ang]_lid": string, "pt2[ang]_pan": string}
uses:
  WebApp::Library.jsli::AddIframe
  WebApp::Library.jsli::InsertURL
  FileTasks::Read File Text.gvi
  WebApp::General_Information.gviweb
  WebApp::Read_XML_Part.gviweb
  WebApp::Order_Sensors_infos.gviweb
  WebApp::Temperature sensors.gviweb
  WebApp::Temperature sensors_Right.gviweb
  WebApp::SSR Commands.gviweb
  WebApp::Pans charge.gviweb
  WebApp::Pressure_in_pan.gviweb
  WebApp::Pressure_in_pan_right.gviweb
  WebApp::Micoswitch.gviweb
  WebApp::Order_Sensors_infos_Part2.gviweb
  WebApp::Valves.gviweb
  WebApp::Motors.gviweb
  WebApp::Angles.gviweb
  WebApp::Graph_Temp.gviweb
  WebApp::Graph_Temp_right.gviweb
  WebApp::Graph_Temp_PCBs.gviweb
  WebApp::Graph_Pressure.gviweb
  WebApp::Graph_Angles.gviweb
diagram:
  w1 = "Init"  # State
  s1 = w1  # shift register
  s2 = string[] []  # shift register
  while {
    case (s1) {
      frame "Init", Default {
        w5 = "Wait For Interaction"  # State
        $"URL-Grafik" <- "Rational_Logo.png"
        Obtain JavaScript Reference(reference in=reference to "HTML Container") -> (javascript reference out=w6)
        call "AddIframe"(container=w6, error in=no error) -> (error out=w7)
        call "InsertURL"(url="WA24_Error_Snapshot.pdf", error in=w7) -> (error out=w8)
        for (N = 13) (iteration -> i1) {
          case (i1) {
            frame 20, Default {
              w2 = w8
            }
            frame 0 {
              Property Node(instance in=reference to "Temperature sensors_Left", "Value"=T10[] [], error in=w8) -> (error out=w9, instance out=w10)
              Close Reference(error in=w9, reference=w10) -> (error out=w11)
              Property Node(instance in=reference to "maximum left", "Value"=f64[] [], error in=w11) -> (error out=w12, instance out=w13)
              Close Reference(error in=w12, reference=w13) -> (error out=w14)
              Property Node(instance in=reference to "minimum left", "Value"=f64[] [], error in=w14) -> (error out=w15, instance out=w16)
              Close Reference(error in=w15, reference=w16) -> (error out=w2)
            }
            frame 1 {
              Property Node(instance in=reference to "Temperature sensors_right", "Value"=T10[] [], error in=w8) -> (error out=w17, instance out=w18)
              Close Reference(error in=w17, reference=w18) -> (error out=w19)
              Property Node(instance in=reference to "maximum right", "Value"=f64[] [], error in=w19) -> (error out=w20, instance out=w21)
              Close Reference(error in=w20, reference=w21) -> (error out=w22)
              Property Node(instance in=reference to "minimum right", "Value"=f64[] [], error in=w22) -> (error out=w23, instance out=w24)
              Close Reference(error in=w23, reference=w24) -> (error out=w2)
            }
            frame 2 {
              Property Node(instance in=reference to "PCB Temperature", "Value"=T4[] [], error in=w8) -> (error out=w25, instance out=w26)
              Close Reference(error in=w25, reference=w26) -> (error out=w27)
              Property Node(instance in=reference to "maximum", "Value"=f64[] [], error in=w27) -> (error out=w28, instance out=w29)
              Close Reference(error in=w28, reference=w29) -> (error out=w30)
              Property Node(instance in=reference to "minimum", "Value"=f64[] [], error in=w30) -> (error out=w31, instance out=w32)
              Close Reference(error in=w31, reference=w32) -> (error out=w2)
            }
            frame 5 {
              Property Node(instance in=reference to "Left side pressure data", "Value"=T5[] [], error in=w8) -> (error out=w33, instance out=w34)
              Close Reference(error in=w33, reference=w34) -> (error out=w35)
              Property Node(instance in=reference to "maximum Pressure left", "Value"=f64[] [], error in=w35) -> (error out=w36, instance out=w37)
              Close Reference(error in=w36, reference=w37) -> (error out=w38)
              Property Node(instance in=reference to "minimum Pressure left", "Value"=f64[] [], error in=w38) -> (error out=w39, instance out=w40)
              Close Reference(error in=w39, reference=w40) -> (error out=w2)
            }
            frame 6 {
              Property Node(instance in=reference to "Right side pressure data", "Value"=T6[] [], error in=w8) -> (error out=w41, instance out=w42)
              Close Reference(error in=w41, reference=w42) -> (error out=w43)
              Property Node(instance in=reference to "maximum Pressure right", "Value"=f64[] [], error in=w43) -> (error out=w44, instance out=w45)
              Close Reference(error in=w44, reference=w45) -> (error out=w46)
              Property Node(instance in=reference to "minimum Pressure right", "Value"=f64[] [], error in=w46) -> (error out=w47, instance out=w48)
              Close Reference(error in=w47, reference=w48) -> (error out=w2)
            }
            frame 10 {
              $"File content:" <- ""
              Property Node(instance in=reference to "Angles", "Value"=T12[] [], error in=w8) -> (error out=w49, instance out=w50)
              Close Reference(error in=w49, reference=w50) -> (error out=w51)
              Property Node(instance in=reference to "maximum Angles", "Value"=f64[] [], error in=w51) -> (error out=w52, instance out=w53)
              Close Reference(error in=w52, reference=w53) -> (error out=w54)
              Property Node(instance in=reference to "minimum Angles", "Value"=f64[] [], error in=w54) -> (error out=w55, instance out=w56)
              Close Reference(error in=w55, reference=w56) -> (error out=w2)
            }
            frame 7 {
              Property Node(instance in=reference to "Microswitch", "Value"=T7[] [], error in=w8) -> (error out=w57, instance out=w58)
              Close Reference(error in=w57, reference=w58) -> (error out=w59)
              Property Node(instance in=reference to "Specifications:", "Value"=T1[] [], error in=w59) -> (error out=w60, instance out=w61)
              Close Reference(error in=w60, reference=w61) -> (error out=w2)
            }
            frame 8 {
              Property Node(instance in=reference to "Valves", "Value"=T8[] [], error in=w8) -> (error out=w62, instance out=w63)
              Close Reference(error in=w62, reference=w63) -> (error out=w2)
            }
            frame 9 {
              Property Node(instance in=reference to "Motors", "Value"=T9[] [], error in=w8) -> (error out=w64, instance out=w65)
              Close Reference(error in=w64, reference=w65) -> (error out=w2)
            }
            frame 3 {
              Property Node(instance in=reference to "SSR Commands_2", "Value"=T3[] [], error in=w8) -> (error out=w66, instance out=w67)
              Close Reference(error in=w66, reference=w67) -> (error out=w2)
            }
            frame 12 {
              Property Node(instance in=reference to "Curve singel_right", "Value"=cluster{"Element 1": f64[], "Element 2": f64[]}[] [], error in=w8) -> (error out=w68, instance out=w69)
              Close Reference(error in=w68, reference=w69) -> (error out=w2)
            }
            frame 13 {
              Property Node(instance in=reference to "Curve temp_PCB", "Value"=cluster{"Element 1": f64[], "Element 2": f64[]}[] [], error in=w8) -> (error out=w70, instance out=w71)
              Close Reference(error in=w70, reference=w71) -> (error out=w2)
            }
            frame 14 {
              Property Node(instance in=reference to "Curve Pressure", "Value"=cluster{"Element 1": f64[], "Element 2": f64[]}[] [], error in=w8) -> (error out=w72, instance out=w73)
              Close Reference(error in=w72, reference=w73) -> (error out=w2)
            }
            frame 15 {
              Property Node(instance in=reference to "Curve angles", "Value"=cluster{"Element 1": f64[], "Element 2": f64[]}[] [], error in=w8) -> (error out=w74, instance out=w75)
              Close Reference(error in=w74, reference=w75) -> (error out=w2)
            }
            frame 11 {
              Property Node(instance in=reference to "Curve singel", "Value"=cluster{"Element 1": f64[], "Element 2": f64[]}[] [], error in=w8) -> (error out=w76, instance out=w77)
              Close Reference(error in=w76, reference=w77) -> (error out=w2)
            }
            frame 4 {
              Property Node(instance in=reference to "SSR Commands", "Value"=T2[] [], error in=w8) -> (error out=w78, instance out=w79)
              Close Reference(error in=w78, reference=w79) -> (error out=w2)
            }
          }
        }
        $"Page 1" <- 0
        w3 = w5
        w4 = s2
      }
      frame "Read XML File" {
        call "Read File Text.gvi"(allowed file types=[".xml"], error in=no error) -> (file content=w80, file name=w81, error out=w82)
        Match Pattern(regular expression="ErrorSnapshots", string=w80) -> (match substring=w83)
        case (w83) {
          frame "False", Default {
            One Button Dialog(message="Please select an 'ErrorSnapshots' XML file !")
            w2 = w82
            w4 = string[] []
            w3 = "Init"
          }
          frame "ErrorSnapshots" {
            $"File content:" <- w80
            call "General_Information.gviweb"(File name=w81, Error Input=w82) -> (General information=w84, Device type=w85, Error Output=w86)
            case (w85) {
              frame "False", Default {
                w87 = "Please select an 'ErrorSnapshots' XML file for 2-S P Device !"
                One Button Dialog(message=w87)
                w3 = "Init"
                w2 = w86
                w4 = string[] []
              }
              frame "2-S P" {
                w88 = "Temperature sensors"  # State
                call "Read_XML_Part.gviweb"(Input XML=w80, Start XML Part="<Sensor>", End XML Part="</Sensor>", Error in=w86) -> (Output XML array=w4, Error out=w2)
                w3 = w88
              }
            }
            $"Specifications:" <- w84
          }
        }
      }
      frame "Temperature sensors" {
        call "Order_Sensors_infos.gviweb"(Input XML array=s2, Error Input=no error) -> (Temperature sensors Left=w89, Error Output=w90)
        call "Temperature sensors.gviweb"(Temperature sensors array=w89, Intput=w90) -> (Temperature sensors=w91, maximum left=w92, minimum left=w93, Output=w94)
        $"Temperature sensors_Left" <- w91
        w95 = "SSR Commands"  # State
        call "Temperature sensors_Right.gviweb"(Temperature sensors array=w89, Intput=w94) -> (Temperature sensors=w96, maximum right=w97, minimum right=w98, Output=w2)
        $"Temperature sensors_right" <- w96
        $"maximum right" <- w97
        $"minimum right" <- w98
        $"maximum left" <- w92
        $"minimum left" <- w93
        w3 = w95
        w4 = s2
      }
      frame "SSR Commands" {
        w99 = "Pans charge"  # State
        call "Order_Sensors_infos.gviweb"(Input XML array=s2, Error Input=no error) -> (SSR Commands=w100, Error Output=w101)
        call "SSR Commands.gviweb"(SSR Commands array=w100, Intput=w101) -> (SSR Commands=w102, Output=w2)
        $"SSR Commands" <- w102
        w3 = w99
        w4 = s2
      }
      frame "Pans charge" {
        w103 = "PCB Temperatures"  # State
        call "Order_Sensors_infos.gviweb"(Input XML array=s2, Error Input=no error) -> (Pans charge=w104, Error Output=w105)
        call "Pans charge.gviweb"(Pans charge array=w104, Intput=w105) -> (Pans charge=w106, Output=w2)
        $"SSR Commands_2" <- w106
        w3 = w103
        w4 = s2
      }
      frame "PCB Temperatures" {
        w107 = "Left side pressure data"  # State
        call "Order_Sensors_infos.gviweb"(Input XML array=s2, Error Input=no error) -> (PCB Temperatures=w108, Error Output=w109)
        call "Pans charge.gviweb"(Pans charge array=w108, Intput=w109) -> (Pans charge=w110, maximum=w111, minimum=w112, Output=w2)
        $"PCB Temperature" <- w110
        $maximum <- w111
        $minimum <- w112
        w3 = w107
        w4 = s2
      }
      frame "Left side pressure data" {
        call "Order_Sensors_infos.gviweb"(Input XML array=s2, Error Input=no error) -> (Error Output=w113, Left side pressure data=w114)
        call "Pressure_in_pan.gviweb"(Pressure_in_pan array=w114, Intput=w113) -> (Pressure_in_pan=w115, maximum Pressure left=w116, minimum Pressure left=w117, Output=w2)
        $"minimum Pressure left" <- w117
        w118 = "Right side pressure data"  # State
        $"Left side pressure data" <- w115
        $"maximum Pressure left" <- w116
        w3 = w118
        w4 = s2
      }
      frame "Right side pressure data" {
        w119 = "Microswitch"  # State
        call "Order_Sensors_infos.gviweb"(Input XML array=s2, Error Input=no error) -> (Right side pressure data=w120)
        call "Pressure_in_pan_right.gviweb"(Pressure_in_pan_right array=w120) -> (Pressure_in_pan_right=w121, maximum Pressure right=w122, minumum Pressure right=w123, Output=w2)
        $"Right side pressure data" <- w121
        $"maximum Pressure right" <- w122
        $"minimum Pressure right" <- w123
        w3 = w119
        w4 = s2
      }
      frame "Microswitch" {
        w124 = "Valves"  # State
        call "Order_Sensors_infos.gviweb"(Input XML array=s2, Error Input=no error) -> (Microswitch=w125, Error Output=w126)
        call "Micoswitch.gviweb"(Micoswitch array=w125, Intput=w126) -> (Microswitch=w127, Output=w2)
        $Microswitch <- w127
        w3 = w124
        w4 = s2
      }
      frame "Valves" {
        w128 = "Motors"  # State
        call "Order_Sensors_infos_Part2.gviweb"(Input XML array=s2, Error Input=no error) -> (Valves=w129, Error Output=w130)
        call "Valves.gviweb"(Valves array=w129, Intput=w130) -> (Valves=w131, Output=w2)
        $Valves <- w131
        w3 = w128
        w4 = s2
      }
      frame "Motors" {
        w132 = "Angles"  # State
        call "Order_Sensors_infos_Part2.gviweb"(Input XML array=s2, Error Input=no error) -> (Motors=w133, Error Output=w134)
        call "Motors.gviweb"(Motors array=w133, Intput=w134) -> (Motors=w135, Output=w2)
        $Motors <- w135
        w3 = w132
        w4 = s2
      }
      frame "Angles" {
        w136 = "Error graph"  # State
        call "Order_Sensors_infos_Part2.gviweb"(Input XML array=s2, Error Input=no error) -> (Angles=w137, Error Output=w138)
        call "Angles.gviweb"(Angles array=w137, Intput=w138) -> (Angles=w139, maximum Angles=w140, minimum Angles=w141, Output=w2)
        $Angles <- w139
        $"maximum Angles" <- w140
        $"minimum Angles" <- w141
        w3 = w136
        w4 = s2
      }
      frame "Error graph" {
        w142 = "Wait For Interaction"  # State
        call "Graph_Temp.gviweb"(Temperature sensors=$"Temperature sensors_Left", Input=no error) -> (Curve singel=w143, Output=w144)
        call "Graph_Temp_right.gviweb"(Temperature sensors_right=$"Temperature sensors_right", Input=w144) -> (Curve singel=w145, Output=w146)
        call "Graph_Temp_PCBs.gviweb"(PCB Temperature=$"PCB Temperature", Input=w146) -> (Curve singel=w147, Output=w148)
        call "Graph_Pressure.gviweb"(Left side pressure data=$"Left side pressure data", Right side pressure data=$"Right side pressure data", Input=w148) -> (Curve singel=w149, Output=w150)
        $"Curve Pressure" <- w149
        call "Graph_Angles.gviweb"(Angles=$Angles, Input=w150) -> (Curve singel=w151, Output=w2)
        $"Curve angles" <- w151
        $"Curve temp_PCB" <- w147
        $"Curve singel_right" <- w145
        $"Curve singel" <- w143
        w3 = w142
        w4 = s2
      }
      frame "Explanations" {
        $"Page 1" <- 11
        w152 = "Wait For Interaction"  # State
        call "Order_Sensors_infos_Part2.gviweb"(Input XML array=s2, Error Input=no error) -> (Motors=w153, Error Output=w154)
        call "Motors.gviweb"(Motors array=w153, Intput=w154) -> (Output=w2)
        w3 = w152
        w4 = s2
      }
      frame "Wait For Interaction" {
        event {
          on "Analyse" Value changed {
            w155 = "Read XML File"  # State
            w2 = no error
            w3 = w155
          }
          on "Explanations" Value changed {
            w156 = "Explanations"  # State
            w2 = no error
            w3 = w156
          }
          on "error graph" Value changed {
            $"Page 1" <- 10
            w157 = "Wait For Interaction"  # State
            w2 = no error
            w3 = w157
          }
        }
        w4 = s2
      }
    }
    next s1 = w3
    next s2 = w4
    stop if FALSE
  }
